# Dynamo custom node Compare levels with storeys_v2.dyf (Dynamo 1.3.3.4651)
# category: MB.graph.levels

settings = Input()
graph_storeys = Input()
revit_levels = Input()
compare_levels_with_storeys = Python(IN[0]=settings, IN[1]=graph_storeys, IN[2]=revit_levels)
# ---------- compare_levels_with_storeys.python (110 lines) ----------
import clr

#The inputs to this node will be stored as a list in the IN variables.
settings = IN[0]
graphList = IN[1]
revitList = IN[2]

#cast elevation strings to float
for graphEl in graphList:
	if graphEl[2] is not None:
		graphEl[2] = float(graphEl[2])

revitModifyName = [False] * len(revitList)
revitNewNames = []
revitModifyElevation = [False] * len(revitList)
revitNewElevations = []
revitDelete = [False] * len(revitList)
revitCreate = [False] * len(graphList)

graphModify = [False] * len(graphList)
graphNewNames = []
graphNewElevations = []
graphDelete = [False] * len(graphList)
graphCreate = [False] * len(revitList)

###########################################
if settings[0]: #graph to Revit
	if settings[1]: #modify Revit levels?
		i = -1
		for revitEl in revitList:
			i += 1
			if revitEl[0] == "": #Level has storey_URI value?
				continue #if empty, there is no corresponding storey to be found
			for graphEl in graphList:
				if revitEl[0] == graphEl[0]: #URI of level corresponds to entity of graph?
					if graphEl[1] is not None:
						revitModifyName[i] = True
						revitNewNames.append(graphEl[1])
					if graphEl[2] is not None:
						revitModifyElevation[i] = True
						revitNewElevations.append(graphEl[2]*1000) # convert meter to mm					
					break #if the corresponding element is found, the comparison can stop					
	
	if settings[2]:	#delete Revit levels?
		revitDelete = [True] * len(revitList)
		i = -1
		for revitEl in revitList:
			i += 1
			if revitEl[0] == "": #Level has storey_URI value?
				continue #if empty, there is no corresponding storey to be found
			for graphEl in graphList:
				if revitEl[0] == graphEl[0]:
					revitDelete[i] = False
					break
	else: revitDelete = [False] * len(revitList)
				
	if settings[3]: #create new Revit levels?
		i = -1
		for graphEl in graphList:
			i += 1
			if graphEl[3] is None: #storey has value for revit_uuid_simple?
				revitCreate[i] = True
				continue
			for revitEl in revitList:
				if graphEl[0] == revitEl[0]: #URI of storey corresponds to Revit level URI?
					revitCreate[i] = False
					break
				else: revitCreate[i] = True
###########################################
else: #Revit to graph
	if settings[4]: #modify graph Storey entities?
		i = -1
		for graphEl in graphList:
			i += 1
			if graphEl[3] is None: #Storey has revit_uuid value?
				continue #if empty, there is no corresponding level to be found
			for revitEl in revitList:
				if revitEl[0] == graphEl[0]: #URI of level corresponds to entity of graph?
					graphModify[i] = True
					graphNewNames.append(revitEl[1])
					graphNewElevations.append(revitEl[2]/1000) #convert mm to meter
					break #if the corresponding element is found, the comparison can stop	
	
	if settings[5]: #delete graph Storey entities?
		graphDelete = [True] * len(graphList)
		i = -1
		for graphEl in graphList:
			i += 1
			if graphEl[3] is None: #Storey has revit_uuid value?
				continue #if empty, there is no corresponding level to be found
			for revitEl in revitList:
				if revitEl[0] == graphEl[0]:
					graphDelete[i] = False
					break
	else: graphDelete = [False] * len(graphList)
	
	if settings[6]: #create new graph Storey entities?
		i = -1
		for revitEl in revitList:
			i += 1
			if revitEl[0] == "": #level has value for storey_URI?
				graphCreate[i] = True
				continue
			for graphEl in graphList:
				if graphEl[0] == revitEl[0]: #URI of storey corresponds to Revit level URI?
					graphCreate[i] = False
					break
				else: graphCreate[i] = True
###########################################				
OUT = [revitModifyName,revitNewNames,revitModifyElevation,revitNewElevations,revitDelete,revitCreate,graphModify,graphNewNames,graphNewElevations,graphDelete,graphCreate]
# ----------------------------------------
code_block = CodeBlock(OUT=compare_levels_with_storeys) { OUT[0]; OUT[1]; OUT[2]; OUT[3]; OUT[4]; OUT[5]; OUT[6]; OUT[7]; OUT[8]; OUT[9]; OUT[10]; }
Revit = Output(code_block.out0)  # "Revit: to modify name"
Revit_2 = Output(code_block.out1)  # "Revit: new names"
Revit_3 = Output(code_block.out2)  # "Revit: to modify elevation"
Revit_4 = Output(code_block.out3)  # "Revit: new elevations"
Revit_5 = Output(code_block.out4)  # "Revit: to delete"
Revit_6 = Output(code_block.out5)  # "Revit: to create"
Graph = Output(code_block.out6)  # "Graph: to modify"
Graph_2 = Output(code_block.out7)  # "Graph: new names"
Graph_3 = Output(code_block.out8)  # "Graph: new elevations"
Graph_4 = Output(code_block.out9)  # "Graph: to delete"
Graph_5 = Output(code_block.out10)  # "Graph: to create"
