# Dynamo custom node Compare revit spaces with graph spaces.dyf (Dynamo 1.3.3.4651)
# category: MB.graph.levels

settings = Input()
graph_spaces = Input()
revit_spaces = Input()
compare_revit_spaces_with_graph = Python(IN[0]=settings, IN[1]=graph_spaces, IN[2]=revit_spaces)  # "Compare revit spaces with graph spaces"
# ---------- compare_revit_spaces_with_graph.python (118 lines) ----------
import clr

#The inputs to this node will be stored as a list in the IN variables.
settings = IN[0]
graphList = IN[1]
revitList = IN[2] # can be empty

# variables
revitModifyName = [] #revitList can be empty
revitNewNames = []
revitModifyNumber = [] #revitList can be empty
revitNewNumbers = []
revitDeleteSpaceLevels = [] #revitList can be empty
revitCreateSpaceLevels = []
revitDelete = [] #revitList can be empty
revitCreate = [False] * len(graphList)

graphModify = [False] * len(graphList)
graphNewNames = []
graphNewNumbers = []
graphDelete = [False] * len(graphList)
graphCreate = [] #revitList can be empty

###########################################
if settings[0]: #graph to Revit
	if settings[1] and revitList is not None: #modify Revit spaces? (revitList can be empty)
		revitModifyName = [False] * len(revitList)
		revitModifyNumber = [False] * len(revitList)
		revitDeleteSpaceLevels = [False] * len(revitList)
		i = -1
		for revitEl in revitList:
			i += 1
			if revitEl[0] == "": #space has space_URI value?
				continue #if empty, there is no corresponding space to be found
			for graphEl in graphList:
				if revitEl[0] == graphEl[0]: #URI of space corresponds to entity of graph?
					if graphEl[1] is not None:
						revitModifyName[i] = True
						revitNewNames.append(graphEl[1])
					if graphEl[2] is not None:
						revitModifyNumber[i] = True
						revitNewNumbers.append(graphEl[2])
					if graphEl[4] != revitEl[4]: #control Level of Revit Space
						revitDeleteSpaceLevels[i] = True # needed to delete spaces (modify levels of spaces)
						revitCreateSpaceLevels.append(graphEl) # needed to create spaces (modify levels of spaces)
					break #if the corresponding element is found, the comparison can stop					
	
	if settings[2] and revitList is not None: #delete Revit spaces? (revitList can be empty)
		revitDelete = [True] * len(revitList)
		i = -1
		for revitEl in revitList:
			i += 1
			if revitEl[0] == "": #space has space_URI value?
				continue #if empty, there is no corresponding space to be found
			for graphEl in graphList:
				if revitEl[0] == graphEl[0]:
					revitDelete[i] = False
					break
				
	if settings[3]: #create new Revit spaces?
		if revitList is None: #(revitList can be empty)
			revitCreate = [True] * len(graphList)
		else:
			i = -1
			for graphEl in graphList:
				i += 1
				if graphEl[3] is None: #space has value for revit_uuid_simple? 
					revitCreate[i] = True
					continue
				for revitEl in revitList:
					if graphEl[0] == revitEl[0]: #URI of space corresponds to Revit space URI?
						revitCreate[i] = False
						break
					else: revitCreate[i] = True
###########################################
else: #Revit to graph
	if settings[4]: #modify graph Space entities?
		i = -1
		for graphEl in graphList:
			i += 1
			if graphEl[3] is None or revitList is None: #space has revit_uuid_simple value? (revitList can be empty)
				continue #if empty, there is no corresponding space to be found
			for revitEl in revitList:
				if revitEl[0] == graphEl[0]: #URI of space corresponds to entity of graph?
					graphModify[i] = True
					graphNewNames.append(revitEl[1])
					graphNewNumbers.append(revitEl[2])
					break #if the corresponding element is found, the comparison can stop	
	
	if settings[5]: #delete graph Space entities?
		graphDelete = [True] * len(graphList)
		if revitList is not None: #revitList can be empty
			i = -1
			for graphEl in graphList:
				i += 1
				if graphEl[3] is None: #space has revit_uuid_simple value?
					continue #if empty, there is no corresponding space to be found
				for revitEl in revitList:
					if revitEl[0] == graphEl[0]:
						graphDelete[i] = False
						break
	
	if settings[6]: #create new graph Space entities?
		if revitList is not None: #revitList can be empty
			graphCreate = [False] * len(revitList)
			i = -1
			for revitEl in revitList:
				i += 1
				if revitEl[0] == "": #space has value for storey_URI?
					graphCreate[i] = True
					continue
				for graphEl in graphList:
					if graphEl[0] == revitEl[0]: #URI of space corresponds to Revit space URI?
						graphCreate[i] = False
						break
					else: graphCreate[i] = True
###########################################
OUT = [revitModifyName,revitNewNames,revitModifyNumber,revitNewNumbers,revitDeleteSpaceLevels,revitCreateSpaceLevels,revitDelete,revitCreate,graphModify,graphNewNames,graphNewNumbers,graphDelete,graphCreate]
# ----------------------------------------
code_block = CodeBlock(OUT=compare_revit_spaces_with_graph) { OUT[0]; OUT[1]; OUT[2]; OUT[3]; OUT[4]; OUT[5]; OUT[6]; OUT[7]; OUT[8]; OUT[9]; OUT[10]; OUT[11]; OUT[12]; }
Revit = Output(code_block.out0)  # "Revit: to modify name"
Revit_2 = Output(code_block.out1)  # "Revit: new names"
Revit_3 = Output(code_block.out2)  # "Revit: to modify number"
Revit_4 = Output(code_block.out3)  # "Revit: new numbers"
Revit_5 = Output(code_block.out4)  # "Revit: to modify space Level (delete)"
Revit_6 = Output(code_block.out5)  # "Revit: to modify space Level (create)"
Revit_7 = Output(code_block.out6)  # "Revit: to delete"
Revit_8 = Output(code_block.out7)  # "Revit: to create"
Graph = Output(code_block.out8)  # "Graph: to modify"
Graph_2 = Output(code_block.out9)  # "Graph: new names"
Graph_3 = Output(code_block.out10)  # "Graph: new numbers"
Graph_4 = Output(code_block.out11)  # "Graph: to delete"
Graph_5 = Output(code_block.out12)  # "Graph: to create"
