# Dynamo custom node Passthrough3.dyf (Dynamo 1.3.3.4651)
# category: Clockwork.Core.Sequence.Query
# Forces a sequential order of execution. The node wired into the output of the Passthrough node will be executed *after* the node wired into the waitFor input (e.g. important for some Revit operations). The value of the passThrough input will be passed on to the node wired into the output port of the Passthrough node.

passThrough = Input()
waitFor1 = Input()
waitFor2 = Input()
waitFor3 = Input()
code_block = CodeBlock(passthrough=passThrough, waitfor1=waitFor1, waitfor2=waitFor2, waitfor3=waitFor3) { {passthrough,waitfor1,waitfor2,waitfor3}[0]; }
passThrough_2 = Output(code_block)  # "passThrough"
