# Dynamo custom node URI generator.dyf (Dynamo 1.3.3.4651)
# category: MB.graph
# Creates a URI based on a base, optional string and a random uuid

URI_base = Input()
number_of_URIs_needed = Input()
Optional_string_after_URI_base = Input()
python_script = Python(IN[0]=URI_base, IN[1]=number_of_URIs_needed, IN[2]=Optional_string_after_URI_base)
# ---------- python_script.python (19 lines) ----------
import clr
import sys
sys.path.append('C:\Program Files (x86)\IronPython 2.7\Lib')
import uuid
#The inputs to this node will be stored as a list in the IN variables.
base = IN[0]
count = IN[1]
optionalString = IN[2]

createdUris = []

if optionalString is None: optionalString = ""

for i in range(count):
	uriStr = base + optionalString + str(uuid.uuid4())
	createdUris.append(uriStr)

#Assign your output to the OUT variable.
OUT = createdUris
# ----------------------------------------
List_of_generated_URIs = Output(python_script)
