# Dynamo graph PART1 - site and building.dyn (Dynamo 1.3.3.4651)

# group: Site/building URI (internal: also shared parameter)
code_block = CodeBlock { {"site_URI","building_URI"}; "Revit UUIDs and graph URIs"; }
checkIfParameterExist = ElementTools.Parameters.CheckIfParameterExist(code_block.out0)
select_parameter_type = ParameterType("URL")
parameter_groups = ParameterGroupUi("PG_IDENTITY_DATA")
# note: Identical results as parameter.createSharedParamater
boolean = BoolSelector(true)
categories = Categories("ProjectInformation")
createProjectParameter = Parameter.CreateProjectParameter(checkIfParameterExist.out1, code_block.out1, select_parameter_type, parameter_groups, boolean, categories)

# group: Query stardog: databases
URL = StringInput("localhost:5820")
user_password = StringInput("admin")
go = BoolSelector(true)
# note: url = IN[0]
# user = IN[1]
# pw = IN[2]
# go = IN[3]
sparql_get_dbs = Python(IN[0]=URL, IN[1]=user_password, IN[2]=user_password, IN[3]=go)
# ---------- sparql_get_dbs.python (47 lines) ----------
import clr
import sys
sys.path.append('C:\Program Files (x86)\IronPython 2.7\Lib')
import httplib, urllib, base64, json 
from urllib2 import Request, urlopen


#The inputs to this node will be stored as a list in the IN variables.
url = IN[0]
user = IN[1]
password = IN[2]
go = IN[3]

if go:
	
	# DB CONNECTION
	
	# Establish connection
	conn = httplib.HTTPConnection(url)
	
	# Encode username and password in base64
	encodedAuth = base64.b64encode('%s:%s' % (user, password))
	
	# Define headers for authorizatio etc.
	#headers = {"authorization": ("Basic %s" % encodedAuth), "Content-type": "application/x-www-form-urlencoded", "Accept": "application/sparql-results+json"}
	headers = {"authorization": ("Basic %s" % encodedAuth)}
	
	# Define parameters (qyery, reasoning etc.)
	params = urllib.urlencode({})
	
	# Send request
	conn.request('GET', '/admin/databases', params, headers)
	
	# Get response
	response = conn.getresponse()
	
	# Read response
	data = response.read()
	
	# Close db connection
	conn.close()

else:
	data = 'off mode'
	
#Assign your output to the OUT variable.
OUT = data
# ----------------------------------------

# group: JSON handling
string = JsonData.Utilities.Parse.String(sparql_get_dbs)
string_2 = StringInput("databases")
getValueByKey = JsonData.Elements.JsonObject.GetValueByKey(string, string_2)

# group: UI: ask for Stardog db
code_block_2 = CodeBlock { "Site-building synchronization options"; "GO!"; }
code_block_3 = CodeBlock { "Stardog database"; }
ui_dropdown_data = Custom[UI.DropDown Data](InputName=code_block_3, Keys=getValueByKey, Values=getValueByKey)  # Create data for DropDown input in UI.MultiInputForm ++ . Check out www.data-shapes.net for more infos.
boolean_2 = BoolSelector(true)
code_block_4 = CodeBlock { "Cancel"; }
ui_multipleinputform = Custom[UI.MultipleInputForm ++](Description_optional=code_block_2.out0, ButtonText_optional=code_block_2.out1, Inputs=ui_dropdown_data, Toggle=boolean_2, CancelButtonText_optional=code_block_4)  # Create a form with multiple inputs. see www.data-shapes.net for tutorials and infos!

# group: Query graph: site and building
URL_2 = StringInput("localhost:5820")
firstItem = List.FirstItem(ui_multipleinputform.User_Inputs)
user_password_2 = StringInput("admin")
query = StringInput("""PREFIX bot: <https://w3id.org/bot#>
SELECT * WHERE {
?site rdf:type bot:Site ;
   bot:hasBuilding ?building .
}""")
reasoning = BoolSelector(false)
go_2 = BoolSelector(true)
# note: url = IN[0]
# db = IN[1]
# user = IN[2]
# password = IN[3]
# query = IN[4]
# reasoning = IN[5]
# go = IN[6]
sparql_get = Python(IN[0]=URL_2, IN[1]=firstItem, IN[2]=user_password_2, IN[3]=user_password_2, IN[4]=query, IN[5]=reasoning, IN[6]=go_2)
# ---------- sparql_get.python (52 lines) ----------
import clr
import sys
sys.path.append('C:\Program Files (x86)\IronPython 2.7\Lib')
import httplib, urllib, base64, json

clr.AddReference('ProtoGeometry')
from Autodesk.DesignScript.Geometry import *
#The inputs to this node will be stored as a list in the IN variables.
url = IN[0]
db = IN[1]
user = IN[2]
password = IN[3]
query = IN[4]
reasoning = IN[5]
go = IN[6]

if go:

	# Defaults
	if not reasoning: reasoning = False
	
	# DB CONNECTION
	
	# Establish connection
	conn = httplib.HTTPConnection(url)
	
	# Encode username and password in base64
	encodedAuth = base64.b64encode('%s:%s' % (user, password))
	
	# Define headers for authorizatio etc.
	headers = {"authorization": ("Basic %s" % encodedAuth), "Content-type": "application/x-www-form-urlencoded", "Accept": "application/sparql-results+json"}
	
	# Define parameters (qyery, reasoning etc.)
	params = urllib.urlencode({"query": query, "reasoning": reasoning})
	
	# Send request
	conn.request('GET', '/'+ db +'/query', params, headers)
	
	# Get response
	response = conn.getresponse()
	
	# Read response
	data = response.read()
	
	# Close db connection
	conn.close()

else:
	data = 'off mode'
	
#Assign your output to the OUT variable.
OUT = data
# ----------------------------------------

# group: JSON handling
string_3 = JsonData.Utilities.Parse.String(sparql_get)
string_4 = StringInput("results.bindings")
getValueByKey_2 = JsonData.Elements.JsonObject.GetValueByKey(string_3, string_4)
code_block_5 = CodeBlock { {"site.value","building.value"}; }
getValueByKey_3 = JsonData.Elements.JsonObject.GetValueByKey(getValueByKey_2, code_block_5, lacing=CrossProduct)

# group: UI
code_block_6 = CodeBlock { "Site-building synchronization options"; "GO!"; }
code_block_7 = CodeBlock { "Site-building combination"; }
ui_dropdown_data_2 = Custom[UI.DropDown Data](InputName=code_block_7, Keys=getValueByKey_3, Values=getValueByKey_3)
code_block_8 = CodeBlock { "Cancel"; }
code_block_9 = CodeBlock { 1500; }
ui_multipleinputform_2 = Custom[UI.MultipleInputForm ++](Description_optional=code_block_6.out0, ButtonText_optional=code_block_6.out1, Inputs=ui_dropdown_data_2, Toggle=ui_multipleinputform.Was_Run, CancelButtonText_optional=code_block_8, Width_optional=code_block_9)

# group: Add site and building URI to Revit project information
categories_2 = Categories("ProjectInformation")
all_elements_of_category = ElementsOfCategory(categories_2)
create = List.Create(code_block.out0)
passthrough = Custom[Passthrough](passThrough=create, waitFor=createProjectParameter)  # Forces a sequential order of execution. The node wired into the output of the Passthrough node will be executed *after* the node wired into the waitFor input (e.g. important for some Revit operations). The value of the passThrough input will be passed on to the node wired into the output port of the Passthrough node.
setParameterByName = Element.SetParameterByName(element=all_elements_of_category, parameterName=passthrough, value=ui_multipleinputform_2.User_Inputs)

# group: Store Stardog db (internal: also shared parameter)
code_block_10 = CodeBlock { {"stardog_db"}; "Revit UUIDs and graph URIs"; }
checkIfParameterExist_2 = ElementTools.Parameters.CheckIfParameterExist(code_block_10.out0)
select_parameter_type_2 = ParameterType("Text")
parameter_groups_2 = ParameterGroupUi("PG_IDENTITY_DATA")
# note: Identical results as parameter.createSharedParamater
boolean_3 = BoolSelector(true)
categories_3 = Categories("ProjectInformation")
createProjectParameter_2 = Parameter.CreateProjectParameter(checkIfParameterExist_2.out1, code_block_10.out1, select_parameter_type_2, parameter_groups_2, boolean_3, categories_3)

# group: Add stardog db to Revit project information
categories_4 = Categories("ProjectInformation")
all_elements_of_category_2 = ElementsOfCategory(categories_4)
passthrough_2 = Custom[Passthrough](passThrough=code_block_10.out0, waitFor=createProjectParameter_2)
setParameterByName_2 = Element.SetParameterByName(element=all_elements_of_category_2, parameterName=passthrough_2, value=firstItem)
