# Dynamo graph PART2 - storeys.dyn (Dynamo 1.3.3.4651)

# group: Find stardog_db of Revit file
categories = Categories("ProjectInformation")
all_elements_of_category = ElementsOfCategory(categories)
firstItem = List.FirstItem(all_elements_of_category)
code_block = CodeBlock { "stardog_db"; }
getParameterValueByName = Element.GetParameterValueByName(element=firstItem, parameterName=code_block)

# group: Find building_URI of Revit file
categories_2 = Categories("ProjectInformation")
all_elements_of_category_2 = ElementsOfCategory(categories_2)
firstItem_2 = List.FirstItem(all_elements_of_category_2)
code_block_2 = CodeBlock { "building_URI"; }
getParameterValueByName_2 = Element.GetParameterValueByName(element=firstItem_2, parameterName=code_block_2)

# group: Query graph: storeys
URL = StringInput("localhost:5820")
user_password = StringInput("admin")
query = StringInput("""PREFIX bot: <https://w3id.org/bot#>
PREFIX props: <https://w3id.org/props#>
SELECT * WHERE {
<building> bot:hasStorey ?storeys .
OPTIONAL {?storeys props:name_simple ?name }
OPTIONAL {?storeys props:elevation_simple ?elevation }
OPTIONAL {?storeys props:revit_uuid_simple ?uuid}
}""")
code_block_3 = CodeBlock { "building"; }
replace = String.Replace(str=query, searchFor=code_block_3, replaceWith=getParameterValueByName_2)
reasoning = BoolSelector(true)
go = BoolSelector(true)
# note: url = IN[0]
# db = IN[1]
# user = IN[2]
# password = IN[3]
# query = IN[4]
# reasoning = IN[5]
# go = IN[6]
sparql_get = Python(IN[0]=URL, IN[1]=getParameterValueByName, IN[2]=user_password, IN[3]=user_password, IN[4]=replace, IN[5]=reasoning, IN[6]=go)
# ---------- sparql_get.python (50 lines) ----------
import clr
import sys
sys.path.append('C:\Program Files (x86)\IronPython 2.7\Lib')
import httplib, urllib, base64, json

#The inputs to this node will be stored as a list in the IN variables.
url = IN[0] # e.g. "localhost:5820"
db = IN[1] # e.g. "mydb"
user = IN[2] # e.g. "admin"
password = IN[3] # e.g. #admin"
query = IN[4] # query in string
reasoning = IN[5] #bool
go = IN[6] #bool

if go:

	# Defaults
	if not reasoning: reasoning = False
	
	# DB CONNECTION
	
	# Establish connection
	conn = httplib.HTTPConnection(url)
	
	# Encode username and password in base64
	encodedAuth = base64.b64encode('%s:%s' % (user, password))
	
	# Define headers for authorizatio etc.
	headers = {"authorization": ("Basic %s" % encodedAuth), "Content-type": "application/x-www-form-urlencoded", "Accept": "application/sparql-results+json"}
	
	# Define parameters (qyery, reasoning etc.)
	params = urllib.urlencode({"query": query, "reasoning": reasoning})
	
	# Send request
	conn.request('GET', '/'+ db +'/query', params, headers)
	
	# Get response
	response = conn.getresponse()
	
	# Read response
	data = response.read()
	
	# Close db connection
	conn.close()

else:
	data = 'off mode'
	
#Assign your output to the OUT variable.
OUT = data
# ----------------------------------------

# group: JSON handling
string = JsonData.Utilities.Parse.String(sparql_get)
string_2 = StringInput("results.bindings")
getValueByKey = JsonData.Elements.JsonObject.GetValueByKey(string, string_2)
code_block_4 = CodeBlock { {"storeys.value","name.value","elevation.value","uuid.value"}; }
getValueByKey_2 = JsonData.Elements.JsonObject.GetValueByKey(getValueByKey, code_block_4, lacing=CrossProduct)

# group: UI: direction of syncronization
code_block_5 = CodeBlock { "Direction of syncronization"; {"Graph to Revit","Revit to graph"}; {true,false}; 0; }
ui_radiobuttons_data = Custom[UI.RadioButtons Data](InputName=code_block_5.out0, Keys=code_block_5.out1, Values=code_block_5.out2, DefaultValueIndex=code_block_5.out3)  # Create radio buttons input for UI.MultipleInputForm ++ .

# group: UI: synchronization options
code_block_6 = CodeBlock { "Graph to Revit: "; true; "Modify Levels?"; }
ui_boolean_input = Custom[UI.Boolean input](InputName=code_block_6.out0, DefaultValue=code_block_6.out1, SideText=code_block_6.out2)  # Creates a boolean input for UI.MultipleInputForm ++ . Check out www.data-shapes.net for more infos!
code_block_7 = CodeBlock { true; "Delete Levels?"; }
ui_boolean_input_2 = Custom[UI.Boolean input](DefaultValue=code_block_7.out0, SideText=code_block_7.out1)
code_block_8 = CodeBlock { true; "Create Levels?"; }
ui_boolean_input_3 = Custom[UI.Boolean input](DefaultValue=code_block_8.out0, SideText=code_block_8.out1)
code_block_9 = CodeBlock { "Revit to graph: "; true; "Modify Storeys?"; }
ui_boolean_input_4 = Custom[UI.Boolean input](InputName=code_block_9.out0, DefaultValue=code_block_9.out1, SideText=code_block_9.out2)
code_block_10 = CodeBlock { false; "Delete Storeys?"; }
ui_boolean_input_5 = Custom[UI.Boolean input](DefaultValue=code_block_10.out0, SideText=code_block_10.out1)
code_block_11 = CodeBlock { true; "Create Storeys?"; }
ui_boolean_input_6 = Custom[UI.Boolean input](DefaultValue=code_block_11.out0, SideText=code_block_11.out1)

# group: UI: URI structure
code_block_12 = CodeBlock { "Base URI creating new storeys:"; "http://example.org/project1/"; }
ui_textbox_data = Custom[UI.TextBox Data](InputName=code_block_12.out0, DefaultText=code_block_12.out1)  # Create Data for TextBox input in UI.MultipleInputForm ++ . Check out www.data-shapes.net for more informations
code_block_13 = CodeBlock { "Optional string after base:"; "storey_"; }
ui_textbox_data_2 = Custom[UI.TextBox Data](InputName=code_block_13.out0, DefaultText=code_block_13.out1)

# group: UI
code_block_14 = CodeBlock { "Storey synchronization options"; "GO!"; }
create = List.Create(ui_radiobuttons_data, ui_boolean_input, ui_boolean_input_2, ui_boolean_input_3, ui_boolean_input_4, ui_boolean_input_5, ui_boolean_input_6, ui_textbox_data, ui_textbox_data_2)
boolean = BoolSelector(true)
code_block_15 = CodeBlock { 500; }
ui_multipleinputform = Custom[UI.MultipleInputForm ++](Description_optional=code_block_14.out0, ButtonText_optional=code_block_14.out1, Inputs=create, Toggle=boolean, Width_optional=code_block_15)  # Create a form with multiple inputs. see www.data-shapes.net for tutorials and infos!

# group: Storey URIs (internal: also shared parameter)
code_block_16 = CodeBlock { "storey_URI"; "Revit UUIDs and graph URIs"; }
checkIfParameterExist = ElementTools.Parameters.CheckIfParameterExist(code_block_16.out0)
select_parameter_type = ParameterType("URL")
parameter_groups = ParameterGroupUi("PG_IDENTITY_DATA")
# note: Identical results as parameter.createSharedParamater
boolean_2 = BoolSelector(true)
categories_3 = Categories("Levels")
createProjectParameter = Parameter.CreateProjectParameter(checkIfParameterExist.out1, code_block_16.out1, select_parameter_type, parameter_groups, boolean_2, categories_3)

# group: Revit categories related to elements
categories_list = Custom[Categories list]()  # Gives list of all Revit categories and a matching list of their names
natural_sort_list_of_strings = Custom[Natural Sort List of Strings](listOfStrings=categories_list.Category_name_s)
code_block_17 = CodeBlock { {"analy","Tags","Annot","view","legend","symbol","grid","line","reference"}; }
code_block_18 = CodeBlock { {"point","area","zone","space","room","boundar","callout","label","coord"}; }
code_block_19 = CodeBlock { {"detail","path","dimens","color","elevation","region","import","level"}; }
code_block_20 = CodeBlock { {"material","graphics","project","image","set toggle","cloud","link","schedule"}; }
code_block_21 = CodeBlock { {"section","scope","sheet","site","spot","number","load","text","title","topography"}; }
code_block_22 = CodeBlock { {"rebar shape"}; }
create_2 = List.Create(code_block_17, code_block_18, code_block_19, code_block_20, code_block_21, code_block_22)
flatten = Flatten(create_2)
code_block_23 = CodeBlock { true; }
contains = String.Contains(str=natural_sort_list_of_strings, searchFor=flatten, ignoreCase=code_block_23, lacing=CrossProduct)
flatten_2 = Flatten()  # unwired: arg0
map = List.Map(list=contains, f_x=flatten_2)
code_block_24 = CodeBlock { true; }
contains_2 = Contains(arg1=code_block_24)  # unwired: arg0
map_2 = List.Map(list=map, f_x=contains_2)
filterByBoolMask = List.FilterByBoolMask(list=natural_sort_list_of_strings, mask=map_2)
byName = Category.ByName(filterByBoolMask.out)
removeNulls = Lists.Manage.RemoveNulls(byName)

# group: Revit UUID (internal: also shared parameter)
code_block_25 = CodeBlock { "revit_UUID"; "Revit UUIDs and graph URIs"; }
checkIfParameterExist_2 = ElementTools.Parameters.CheckIfParameterExist(code_block_25.out0)
select_parameter_type_2 = ParameterType("Text")
parameter_groups_2 = ParameterGroupUi("PG_IDENTITY_DATA")
boolean_3 = BoolSelector(true)
categories_4 = Categories("Levels")
categories_5 = Categories("MEPSpaces")
addItemToFront = List.AddItemToFront(item=categories_5, list=removeNulls)
# note: Identical results as parameter.createSharedParamater
addItemToFront_2 = List.AddItemToFront(item=categories_4, list=addItemToFront)
createProjectParameter_2 = Parameter.CreateProjectParameter(checkIfParameterExist_2.out1, code_block_25.out1, select_parameter_type_2, parameter_groups_2, boolean_3, addItemToFront_2)

# group: Query Revit model
categories_6 = Categories("Levels")
passthrough2 = Custom[Passthrough2](passThrough=categories_6, waitFor1=createProjectParameter, waitFor2=createProjectParameter_2)  # Forces a sequential order of execution. The node wired into the output of the Passthrough node will be executed *after* the node wired into the waitFor input (e.g. important for some Revit operations). The value of the passThrough input will be passed on to the node wired into the output port of the Passthrough node.
all_elements_of_category_3 = ElementsOfCategory(passthrough2)
code_block_26 = CodeBlock()
# ---------- code_block_26.designscript (3 lines) ----------
{"storey_URI","Name","Elevation","revit_UUID"};
 //needs cross product
 //empty parameter value => empty string
# ----------------------------------------
getParameterValueByName_3 = Element.GetParameterValueByName(element=all_elements_of_category_3, parameterName=code_block_26, lacing=CrossProduct)

compare_levels_with_storeys_v2 = Custom[Compare levels with storeys_v2](settings=ui_multipleinputform.User_Inputs, graph_storeys=getValueByKey_2, revit_levels=getParameterValueByName_3)

# group: Temporary level => allow to delete all levels if necessary
code_block_27 = CodeBlock { 0; "temporary level when deleting all levels"; }
passthrough = Custom[Passthrough](passThrough=code_block_27.out0, waitFor=compare_levels_with_storeys_v2.Revit_to_delete)  # Forces a sequential order of execution. The node wired into the output of the Passthrough node will be executed *after* the node wired into the waitFor input (e.g. important for some Revit operations). The value of the passThrough input will be passed on to the node wired into the output port of the Passthrough node.
byElevationAndName = Level.ByElevationAndName(passthrough, code_block_27.out1)

# group: Modify - Delete - create Revit levels according to Linked Data input
replace_nulls_in_graph_list = Python(IN[0]=getValueByKey_2)  # "Replace nulls in graph list + convert dist to mm"
# ---------- replace_nulls_in_graph_list.python (20 lines) ----------
import clr
clr.AddReference('ProtoGeometry')
from Autodesk.DesignScript.Geometry import *
#The inputs to this node will be stored as a list in the IN variables.
startList = IN[0]
a = 0

#element = startList[4]
for sublist in startList:
	if sublist[1] is None:
		sublist[1] = "No value in graph" #storey name
	if sublist[2] is None:
		value = -1.23456789-a #storey elevation in meter
		sublist[2] = value
		a += 2
	#cast elevation from string to float + convert m to mm
	sublist[2] = 1000*float(sublist[2])

#Assign your output to the OUT variable.
OUT = startList
# ----------------------------------------
filterByBoolMask_2 = List.FilterByBoolMask(list=all_elements_of_category_3, mask=compare_levels_with_storeys_v2.Revit_to_delete)
filterByBoolMask_3 = List.FilterByBoolMask(list=all_elements_of_category_3, mask=compare_levels_with_storeys_v2.Revit_to_modify_elevation)
code_block_28 = CodeBlock { "Elevation"; }
setParameterByName = Element.SetParameterByName(element=filterByBoolMask_3.in, parameterName=code_block_28, value=compare_levels_with_storeys_v2.Revit_new_elevations)
filterByBoolMask_4 = List.FilterByBoolMask(list=all_elements_of_category_3, mask=compare_levels_with_storeys_v2.Revit_to_modify_name)
code_block_29 = CodeBlock { "Name"; }
setParameterByName_2 = Element.SetParameterByName(element=filterByBoolMask_4.in, parameterName=code_block_29, value=compare_levels_with_storeys_v2.Revit_new_names)
passthrough3 = Custom[Passthrough3](passThrough=filterByBoolMask_2.in, waitFor1=setParameterByName, waitFor2=setParameterByName_2, waitFor3=byElevationAndName)  # Forces a sequential order of execution. The node wired into the output of the Passthrough node will be executed *after* the node wired into the waitFor input (e.g. important for some Revit operations). The value of the passThrough input will be passed on to the node wired into the output port of the Passthrough node.
delete = Archilab.Grimshaw.Elements.Element.Delete(passthrough3)
passthrough_2 = Custom[Passthrough](passThrough=compare_levels_with_storeys_v2.Revit_to_create, waitFor=delete)
filterByBoolMask_5 = List.FilterByBoolMask(list=replace_nulls_in_graph_list, mask=passthrough_2)
transpose = List.Transpose(filterByBoolMask_5.in)
code_block_30 = CodeBlock { 1; 2; }
getItemAtIndex = List.GetItemAtIndex(list=transpose, index=code_block_30.out1)
getItemAtIndex_2 = List.GetItemAtIndex(list=transpose, index=code_block_30.out0)
byElevationAndName_2 = Level.ByElevationAndName(getItemAtIndex, getItemAtIndex_2)
byLevel = FloorPlanView.ByLevel(byElevationAndName_2)

# group: Manually control if all necessary categories are included
string_from_object = FromObject(addItemToFront_2)
code_block_31 = CodeBlock()
# ---------- code_block_31.designscript (3 lines) ----------
"Spaces";
//not incl;
"Levels";
# ----------------------------------------
containsItem = List.ContainsItem(list=string_from_object, item=code_block_31.out1)

# group: Set storey_URI
code_block_32 = CodeBlock { "storey_URI"; }
transpose_2 = List.Transpose(getValueByKey_2)
firstItem_3 = List.FirstItem(transpose_2)
setParameterByName_3 = Element.SetParameterByName(element=byElevationAndName_2, parameterName=code_block_32, value=firstItem_3)

# group: Set revit_UUID
code_block_33 = CodeBlock { "revit_UUID"; }
uniqueId = Element.UniqueId(byElevationAndName_2)
setParameterByName_4 = Element.SetParameterByName(element=byElevationAndName_2, parameterName=code_block_33, value=uniqueId)

# group (continued): Temporary level => allow to delete all levels if necessary
passthrough_3 = Custom[Passthrough](passThrough=byElevationAndName, waitFor=byElevationAndName_2)
delete_2 = Archilab.Grimshaw.Elements.Element.Delete(passthrough_3)

code_block_34 = CodeBlock(OUT=ui_multipleinputform.User_Inputs) { OUT[7]; OUT[8]; }
prepare_for_sparql_insert_data = Python(IN[0]=firstItem_3, IN[1]=uniqueId)
# ---------- prepare_for_sparql_insert_data.python (13 lines) ----------
import clr

#The inputs to this node will be stored as a list in the IN variables.
uris = IN[0]
uuids = IN[1]

urisAndUuids = ""

for i in range(len(uris)):
	urisAndUuids = urisAndUuids + '\n' + "( <" + uris[i] + "> \"" + uuids[i] + "\" )"

#Assign your output to the OUT variable.
OUT = urisAndUuids
# ----------------------------------------

# group: Control queries via settings
code_block_35 = CodeBlock(OUT=ui_multipleinputform.User_Inputs) { OUT[0]; OUT[3]; OUT[4]; OUT[5]; OUT[6]; }
and_ = And(code_block_35.out0, code_block_35.out1)
code_block_36 = CodeBlock { false; true; }
if_ = If(test=code_block_35.out0, true=code_block_36.out0, false=code_block_36.out1)
and_2 = And(code_block_35.out2, if_)
and_3 = And(code_block_35.out3, if_)
and_4 = And(code_block_35.out4, if_)

# group: Query graph: write revit_uuid
URL_2 = StringInput("localhost:5820")
user_password_2 = StringInput("admin")
query_2 = StringInput("""PREFIX props: <https://w3id.org/props#>
DELETE {
?storeys props:revit_uuid_simple ?origUuid .
}
INSERT {
?storeys props:revit_uuid_simple ?uuid .
} 
WHERE {
?storeys ?p ?o .
OPTIONAL {?storeys props:revit_uuid_simple ?origUuid .}
VALUES (?storeys ?uuid){<values>
}
}""")
code_block_37 = CodeBlock { "<values>"; }
replace_2 = String.Replace(str=query_2, searchFor=code_block_37, replaceWith=prepare_for_sparql_insert_data)
reasoning_2 = BoolSelector(false)
# note: [0]URL
# [1]DB
# [2]user
# [3]pw
# [4]query
# [5]reasoning?
# [6]go?
post_data = Python(IN[0]=URL_2, IN[1]=getParameterValueByName, IN[2]=user_password_2, IN[3]=user_password_2, IN[4]=replace_2, IN[5]=reasoning_2, IN[6]=and_)
# ---------- post_data.python (51 lines) ----------
import clr
import sys
sys.path.append('C:\Program Files (x86)\IronPython 2.7\Lib')
import httplib, urllib, json, base64, time

clr.AddReference('ProtoGeometry')
from Autodesk.DesignScript.Geometry import *
#The inputs to this node will be stored as a list in the IN variables.
url = IN[0]
db = IN[1]
user = IN[2]
password = IN[3]
query = IN[4]
reasoning = IN[5]
go = IN[6]

if go:
	
    #DB CONNECTION
	
    # Establish connection
	conn = httplib.HTTPConnection(url)
	
    # Encode username and password in base64
	encodedAuth = base64.b64encode('%s:%s' % (user, password))
	
    # Define headers for authorizatio etc.
	headers = {"authorization": ("Basic %s" % encodedAuth), "Content-type": "application/x-www-form-urlencoded", "Accept": "text/boolean"}
	
    # Define parameters (qyery, reasoning etc.)
	body = 'query=%s' % query
   	#body = urlencode({"query": query, "reasoning": reasoning})
   	#params = urllib.urlencode({"query": query, "reasoning": reasoning})
	
    # Send request
	conn.request('POST', '/'+ db +'/update', body, headers)
	
    # Get response
	response = conn.getresponse()
	
    # Read response
	data = response.status, response.reason
	
    # Close db connection
	conn.close()

else:
	data = "off mode"

#Assign your output to the OUT variable.
OUT = data
# ----------------------------------------
watch = Watch(post_data)

# group: Data processing for modifying storeys
filterByBoolMask_6 = List.FilterByBoolMask(list=getValueByKey_2, mask=compare_levels_with_storeys_v2.Graph_to_modify)
transpose_3 = List.Transpose(filterByBoolMask_6.in)
firstItem_4 = List.FirstItem(transpose_3)
prepare_for_sparql_values = Python(IN[0]=firstItem_4, IN[1]=compare_levels_with_storeys_v2.Graph_new_names, IN[2]=compare_levels_with_storeys_v2.Graph_new_elevations)  # "Prepare for SPARQL VALUES <storeyMod>"
# ---------- prepare_for_sparql_values.python (14 lines) ----------
import clr

#The inputs to this node will be stored as a list in the IN variables.
uris = IN[0]
names = IN[1]
elevations = IN[2]

storeysMod = ""

for i in range(len(uris)):
	storeysMod = storeysMod + '\n' + "( <" + uris[i] + "> \"" + names[i] + "\" " + str(elevations[i]) + " )"

#Assign your output to the OUT variable.
OUT = storeysMod
# ----------------------------------------

# group: Query graph: modify storeys
URL_3 = StringInput("localhost:5820")
user_password_3 = StringInput("admin")
query_3 = StringInput("""PREFIX props: <https://w3id.org/props#>
DELETE {
?storeys props:name_simple ?origName ;
 props:elevation_simple ?origElevation .
}
INSERT {
?storeys props:name_simple ?names ;
 props:elevation_simple ?elevations .
}
WHERE {
?storeys ?p ?o .
OPTIONAL { ?storeys props:name_simple ?origName }
OPTIONAL { ?storeys props:elevation_simple ?origElevation }
VALUES (?storeys ?names ?elevations) {<storeysMod>
}
}""")
code_block_38 = CodeBlock { "<storeysMod>"; }
replace_3 = String.Replace(str=query_3, searchFor=code_block_38, replaceWith=prepare_for_sparql_values)
reasoning_3 = BoolSelector(false)
# note: [0]URL
# [1]DB
# [2]user
# [3]pw
# [4]query
# [5]reasoning?
# [6]go?
post_data_2 = Python(IN[0]=URL_3, IN[1]=getParameterValueByName, IN[2]=user_password_3, IN[3]=user_password_3, IN[4]=replace_3, IN[5]=reasoning_3, IN[6]=and_2)
# ---------- post_data_2.python (48 lines) ----------
import clr
import sys
sys.path.append('C:\Program Files (x86)\IronPython 2.7\Lib')
import httplib, urllib, json, base64, time

#The inputs to this node will be stored as a list in the IN variables.
url = IN[0]
db = IN[1]
user = IN[2]
password = IN[3]
query = IN[4]
reasoning = IN[5]
go = IN[6]

if go:
	
    #DB CONNECTION
	
    # Establish connection
	conn = httplib.HTTPConnection(url)
	
    # Encode username and password in base64
	encodedAuth = base64.b64encode('%s:%s' % (user, password))
	
    # Define headers for authorizatio etc.
	headers = {"authorization": ("Basic %s" % encodedAuth), "Content-type": "application/x-www-form-urlencoded", "Accept": "text/boolean"}
	
    # Define parameters (qyery, reasoning etc.)
	body = 'query=%s' % query
   	#body = urlencode({"query": query, "reasoning": reasoning})
	
    # Send request
	conn.request('POST', '/'+ db +'/update', body, headers)
	
    # Get response
	response = conn.getresponse()
	
    # Read response
	data = response.status, response.reason
	
    # Close db connection
	conn.close()

else:
	data = "off mode"

#Assign your output to the OUT variable.
OUT = data
# ----------------------------------------
watch_2 = Watch(post_data_2)

# group: Control lists manually
watch_3 = Watch(getParameterValueByName_3)
watch_4 = Watch(getValueByKey_2)

# group: Data processing for deleting storeys
filterByBoolMask_7 = List.FilterByBoolMask(list=getValueByKey_2, mask=compare_levels_with_storeys_v2.Graph_to_delete)
transpose_4 = List.Transpose(filterByBoolMask_7.in)
firstItem_5 = List.FirstItem(transpose_4)
prepare_for_sparql_values_2 = Python(IN[0]=firstItem_5)  # "Prepare for SPARQL VALUES <storeyDel>"
# ---------- prepare_for_sparql_values_2.python (12 lines) ----------
import clr

#The inputs to this node will be stored as a list in the IN variables.
uris = IN[0]

storeysDel = ""

for i in range(len(uris)):
	storeysDel = storeysDel + '\n' + " <" + uris[i] + ">"

#Assign your output to the OUT variable.
OUT = storeysDel
# ----------------------------------------

# group: Query graph: delete storeys
URL_4 = StringInput("localhost:5820")
user_password_4 = StringInput("admin")
query_4 = StringInput("""PREFIX props: <https://w3id.org/props#>
DELETE {
?storeys ?p1 ?o .
?s ?p2 ?storeys .
}
WHERE {
?storeys ?p1 ?o .
OPTIONAL {?s ?p2 ?storeys .}
VALUES ?storeys {<storeysDel>
 }
}""")
code_block_39 = CodeBlock { "<storeysDel>"; }
replace_4 = String.Replace(str=query_4, searchFor=code_block_39, replaceWith=prepare_for_sparql_values_2)
reasoning_4 = BoolSelector(true)
# note: [0]URL
# [1]DB
# [2]user
# [3]pw
# [4]query
# [5]reasoning?
# [6]go?
post_data_3 = Python(IN[0]=URL_4, IN[1]=getParameterValueByName, IN[2]=user_password_4, IN[3]=user_password_4, IN[4]=replace_4, IN[5]=reasoning_4, IN[6]=and_3)
# ---------- post_data_3.python (50 lines) ----------
import clr
import sys
sys.path.append('C:\Program Files (x86)\IronPython 2.7\Lib')
import httplib, urllib, json, base64, time

clr.AddReference('ProtoGeometry')
from Autodesk.DesignScript.Geometry import *
#The inputs to this node will be stored as a list in the IN variables.
url = IN[0]
db = IN[1]
user = IN[2]
password = IN[3]
query = IN[4]
reasoning = IN[5]
go = IN[6]

if go:
	
    #DB CONNECTION
	
    # Establish connection
	conn = httplib.HTTPConnection(url)
	
    # Encode username and password in base64
	encodedAuth = base64.b64encode('%s:%s' % (user, password))
	
    # Define headers for authorizatio etc.
	headers = {"authorization": ("Basic %s" % encodedAuth), "Content-type": "application/x-www-form-urlencoded", "Accept": "text/boolean"}
	
    # Define parameters (query, reasoning etc.)
	#body = 'query=%s' % query
   	body = urllib.urlencode({"query": query, "reasoning": reasoning})
	
    # Send request
	conn.request('POST', '/'+ db +'/update', body, headers)
	
    # Get response
	response = conn.getresponse()
	
    # Read response
	data = response.status, response.reason
	
    # Close db connection
	conn.close()

else:
	data = "off mode"

#Assign your output to the OUT variable.
OUT = data
# ----------------------------------------
watch_5 = Watch(post_data_3)

# group: Get Level name and elevation
filterByBoolMask_8 = List.FilterByBoolMask(list=getParameterValueByName_3, mask=compare_levels_with_storeys_v2.Graph_to_create)
transpose_5 = List.Transpose(filterByBoolMask_8.in)
code_block_40 = CodeBlock()
# ---------- code_block_40.designscript (4 lines) ----------
//name
1;
//elevation
2;
# ----------------------------------------
getItemAtIndex_3 = List.GetItemAtIndex(list=transpose_5, index=code_block_40.out0)
getItemAtIndex_4 = List.GetItemAtIndex(list=transpose_5, index=code_block_40.out1)

# group: Data processing for creating new storeys
filterByBoolMask_9 = List.FilterByBoolMask(list=all_elements_of_category_3, mask=compare_levels_with_storeys_v2.Graph_to_create)

# group: Set revit_UUID
code_block_41 = CodeBlock { "revit_UUID"; }
uniqueId_2 = Element.UniqueId(filterByBoolMask_9.in)
setParameterByName_5 = Element.SetParameterByName(element=filterByBoolMask_9.in, parameterName=code_block_41, value=uniqueId_2)

# group: URI generator
count = Count(filterByBoolMask_9.in)
uri_generator = Custom[URI generator](URI_base=code_block_34.out0, number_of_URIs_needed=count, Optional_string_after_URI_base=code_block_34.out1)  # Creates a URI based on a base, optional string and a random uuid

# group: Set storey_URI
code_block_42 = CodeBlock { "storey_URI"; }
setParameterByName_6 = Element.SetParameterByName(element=filterByBoolMask_9.in, parameterName=code_block_42, value=uri_generator)

# group (continued): Data processing for creating new storeys
prepare_for_sparql_values_3 = Python(IN[0]=uri_generator, IN[1]=getItemAtIndex_3, IN[2]=getItemAtIndex_4, IN[3]=uniqueId_2)  # "Prepare for SPARQL VALUES <storeyCrea>"
# ---------- prepare_for_sparql_values_3.python (15 lines) ----------
import clr

#The inputs to this node will be stored as a list in the IN variables.
uris = IN[0]
names = IN[1]
elevations = IN[2] # still in mm from Revit => convert to meter
uuids = IN[3]

storeysCrea = ""

for i in range(len(uris)):
	storeysCrea = storeysCrea + '\n' + "( <" + uris[i] + "> \"" + names[i] + "\" " + str(elevations[i]/1000) + " \"" + uuids[i] + "\" )"

#Assign your output to the OUT variable.
OUT = storeysCrea
# ----------------------------------------

# group: Query graph: create storeys
URL_5 = StringInput("localhost:5820")
user_password_5 = StringInput("admin")
query_5 = StringInput("""PREFIX props: <https://w3id.org/props#>
INSERT {
<building> bot:hasStorey ?storeys .
?storeys props:name_simple ?names ;
 props:elevation_simple ?elevations ;
 props:revit_uuid_simple ?uuid .
}
WHERE {
VALUES (?storeys ?names ?elevations ?uuid) {<storeysCrea>
 } 
}""")
code_block_43 = CodeBlock { "<storeysCrea>"; }
replace_5 = String.Replace(str=query_5, searchFor=code_block_43, replaceWith=prepare_for_sparql_values_3)
code_block_44 = CodeBlock { "building"; }
replace_6 = String.Replace(str=replace_5, searchFor=code_block_44, replaceWith=getParameterValueByName_2)
reasoning_5 = BoolSelector(false)
# note: [0]URL
# [1]DB
# [2]user
# [3]pw
# [4]query
# [5]reasoning?
# [6]go?
post_data_4 = Python(IN[0]=URL_5, IN[1]=getParameterValueByName, IN[2]=user_password_5, IN[3]=user_password_5, IN[4]=replace_6, IN[5]=reasoning_5, IN[6]=and_4)
# ---------- post_data_4.python (49 lines) ----------
import clr
import sys
sys.path.append('C:\Program Files (x86)\IronPython 2.7\Lib')
import httplib, urllib, json, base64, time

#The inputs to this node will be stored as a list in the IN variables.
url = IN[0]
db = IN[1]
user = IN[2]
password = IN[3]
query = IN[4]
reasoning = IN[5]
go = IN[6]

if go:
	
    #DB CONNECTION
	
    # Establish connection
	conn = httplib.HTTPConnection(url)
	
    # Encode username and password in base64
	encodedAuth = base64.b64encode('%s:%s' % (user, password))
	
    # Define headers for authorizatio etc.
	headers = {"authorization": ("Basic %s" % encodedAuth), "Content-type": "application/x-www-form-urlencoded", "Accept": "text/boolean"}
	
    # Define parameters (qyery, reasoning etc.)
	body = 'query=%s' % query
   	#body = urlencode({"query": query, "reasoning": reasoning})
   	#params = urllib.urlencode({"query": query, "reasoning": reasoning})
	
    # Send request
	conn.request('POST', '/'+ db +'/update', body, headers)
	
    # Get response
	response = conn.getresponse()
	
    # Read response
	data = response.status, response.reason
	
    # Close db connection
	conn.close()

else:
	data = "off mode"

#Assign your output to the OUT variable.
OUT = data
# ----------------------------------------
watch_6 = Watch(post_data_4)
