# Dynamo graph PART3 - spaces.dyn (Dynamo 1.3.3.4651)

# group: Find stardog_db of Revit file
categories = Categories("ProjectInformation")
all_elements_of_category = ElementsOfCategory(categories)
firstItem = List.FirstItem(all_elements_of_category)
code_block = CodeBlock { "stardog_db"; }
getParameterValueByName = Element.GetParameterValueByName(element=firstItem, parameterName=code_block)

# group: Find building_URI of Revit file
categories_2 = Categories("ProjectInformation")
all_elements_of_category_2 = ElementsOfCategory(categories_2)
firstItem_2 = List.FirstItem(all_elements_of_category_2)
code_block_2 = CodeBlock { "building_URI"; }
getParameterValueByName_2 = Element.GetParameterValueByName(element=firstItem_2, parameterName=code_block_2)

# group: Query graph: storeys
URL = StringInput("localhost:5820")
user_password = StringInput("admin")
query = StringInput("""PREFIX bot: <https://w3id.org/bot#>
PREFIX props: <https://w3id.org/props#>
SELECT ?spaces ?name ?number ?uuid ?storeys WHERE {
<building> bot:hasStorey ?storeys .
?storeys bot:hasSpace ?spaces
OPTIONAL {?spaces props:name_simple ?name }
OPTIONAL {?spaces props:number_simple ?number}
OPTIONAL {?spaces props:revit_uuid_simple ?uuid}
}""")
code_block_3 = CodeBlock { "building"; }
replace = String.Replace(str=query, searchFor=code_block_3, replaceWith=getParameterValueByName_2)
reasoning = BoolSelector(true)
go = BoolSelector(true)
# note: url = IN[0]
# db = IN[1]
# user = IN[2]
# password = IN[3]
# query = IN[4]
# reasoning = IN[5]
# go = IN[6]
sparql_get = Python(IN[0]=URL, IN[1]=getParameterValueByName, IN[2]=user_password, IN[3]=user_password, IN[4]=replace, IN[5]=reasoning, IN[6]=go)
# ---------- sparql_get.python (52 lines) ----------
import clr
import sys
sys.path.append('C:\Program Files (x86)\IronPython 2.7\Lib')
import httplib, urllib, base64, json

clr.AddReference('ProtoGeometry')
from Autodesk.DesignScript.Geometry import *
#The inputs to this node will be stored as a list in the IN variables.
url = IN[0]
db = IN[1]
user = IN[2]
password = IN[3]
query = IN[4]
reasoning = IN[5]
go = IN[6]

if go:

	# Defaults
	if not reasoning: reasoning = False
	
	# DB CONNECTION
	
	# Establish connection
	conn = httplib.HTTPConnection(url)
	
	# Encode username and password in base64
	encodedAuth = base64.b64encode('%s:%s' % (user, password))
	
	# Define headers for authorizatio etc.
	headers = {"authorization": ("Basic %s" % encodedAuth), "Content-type": "application/x-www-form-urlencoded", "Accept": "application/sparql-results+json"}
	
	# Define parameters (qyery, reasoning etc.)
	params = urllib.urlencode({"query": query, "reasoning": reasoning})
	
	# Send request
	conn.request('GET', '/'+ db +'/query', params, headers)
	
	# Get response
	response = conn.getresponse()
	
	# Read response
	data = response.read()
	
	# Close db connection
	conn.close()

else:
	data = 'off mode'
	
#Assign your output to the OUT variable.
OUT = data
# ----------------------------------------

# group: JSON handling
string = JsonData.Utilities.Parse.String(sparql_get)
string_2 = StringInput("results.bindings")
getValueByKey = JsonData.Elements.JsonObject.GetValueByKey(string, string_2)
code_block_4 = CodeBlock { {"spaces.value","name.value","number.value","uuid.value","storeys.value"}; }
getValueByKey_2 = JsonData.Elements.JsonObject.GetValueByKey(getValueByKey, code_block_4, lacing=CrossProduct)

# group: UI: direction of syncronization
code_block_5 = CodeBlock { "Direction of syncronization"; {"Graph to Revit","Revit to graph"}; {true,false}; 0; }
ui_radiobuttons_data = Custom[UI.RadioButtons Data](InputName=code_block_5.out0, Keys=code_block_5.out1, Values=code_block_5.out2, DefaultValueIndex=code_block_5.out3)  # Create radio buttons input for UI.MultipleInputForm ++ .

# group: UI: synchronization options
code_block_6 = CodeBlock { "Graph to Revit: "; true; "Modify Revit spaces?"; }
ui_boolean_input = Custom[UI.Boolean input](InputName=code_block_6.out0, DefaultValue=code_block_6.out1, SideText=code_block_6.out2)  # Creates a boolean input for UI.MultipleInputForm ++ . Check out www.data-shapes.net for more infos!
code_block_7 = CodeBlock { true; "Delete Revit spaces?"; }
ui_boolean_input_2 = Custom[UI.Boolean input](DefaultValue=code_block_7.out0, SideText=code_block_7.out1)
code_block_8 = CodeBlock { true; "Create Revit spaces?"; }
ui_boolean_input_3 = Custom[UI.Boolean input](DefaultValue=code_block_8.out0, SideText=code_block_8.out1)
code_block_9 = CodeBlock { "Revit to graph: "; true; "Modify graph Spaces?"; }
ui_boolean_input_4 = Custom[UI.Boolean input](InputName=code_block_9.out0, DefaultValue=code_block_9.out1, SideText=code_block_9.out2)
code_block_10 = CodeBlock { false; "Delete graph Spaces?"; }
ui_boolean_input_5 = Custom[UI.Boolean input](DefaultValue=code_block_10.out0, SideText=code_block_10.out1)
code_block_11 = CodeBlock { true; "Create graph Spaces?"; }
ui_boolean_input_6 = Custom[UI.Boolean input](DefaultValue=code_block_11.out0, SideText=code_block_11.out1)

# group: UI: URI structure
code_block_12 = CodeBlock { "Base URI used when creating new Spaces:"; "http://example.org/project1/"; }
ui_textbox_data = Custom[UI.TextBox Data](InputName=code_block_12.out0, DefaultText=code_block_12.out1)  # Create Data for TextBox input in UI.MultipleInputForm ++ . Check out www.data-shapes.net for more informations
code_block_13 = CodeBlock { "Optional string after base URI:"; "space_"; }
ui_textbox_data_2 = Custom[UI.TextBox Data](InputName=code_block_13.out0, DefaultText=code_block_13.out1)

# group: UIT: location revit spaces
code_block_14 = CodeBlock { "Location of new Revit Space placeholders"; }
code_block_15 = CodeBlock { "Start X-coordinate (in project units)"; }
code_block_16 = CodeBlock { "0"; "-15000"; }
ui_textbox_data_3 = Custom[UI.TextBox Data](InputName=code_block_15, DefaultText=code_block_16.out0)
code_block_17 = CodeBlock { "X-step in east direction"; 1; 5000; 3000; 1; }
slider = Custom[UI.Slider](InputName=code_block_17.out0, Minimum=code_block_17.out1, Maximum=code_block_17.out2, Default_Value=code_block_17.out3, Step=code_block_17.out4)  # Creates slider input for UI.MultipleInputForm ++ . Set the step to decimal value if you want a double slider, or to a integer value if you want an integer slider.

code_block_18 = CodeBlock { "Start Y-coordinate (in project units)"; }
ui_textbox_data_4 = Custom[UI.TextBox Data](InputName=code_block_18, DefaultText=code_block_16.out1)

# group (continued): UIT: location revit spaces
create = List.Create(ui_textbox_data_3, ui_textbox_data_4, slider)
ui_inputgroup_data = Custom[UI.InputGroup Data](GroupTitle=code_block_14, Inputs=create)  # Creates a group of inputs for UI.MultipleInputForm ++ . Check out www.data-shapes.net for more infos !

# group: UI
code_block_19 = CodeBlock { "Space synchronization options"; "GO!"; }
create_2 = List.Create(ui_radiobuttons_data, ui_boolean_input, ui_boolean_input_2, ui_boolean_input_3, ui_boolean_input_4, ui_boolean_input_5, ui_boolean_input_6, ui_textbox_data, ui_textbox_data_2, ui_inputgroup_data)
boolean = BoolSelector(true)
code_block_20 = CodeBlock { "cancel"; }
code_block_21 = CodeBlock { 500; }
ui_multipleinputform = Custom[UI.MultipleInputForm ++](Description_optional=code_block_19.out0, ButtonText_optional=code_block_19.out1, Inputs=create_2, Toggle=boolean, CancelButtonText_optional=code_block_20, Width_optional=code_block_21)  # Create a form with multiple inputs. see www.data-shapes.net for tutorials and infos!

# group: Space URIs (internal: also shared parameter)
code_block_22 = CodeBlock { "space_URI"; "Revit UUIDs and graph URIs"; }
checkIfParameterExist = ElementTools.Parameters.CheckIfParameterExist(code_block_22.out0)
select_parameter_type = ParameterType("URL")
parameter_groups = ParameterGroupUi("PG_IDENTITY_DATA")
# note: Identical results as parameter.createSharedParamater
boolean_2 = BoolSelector(true)
categories_3 = Categories("MEPSpaces")
createProjectParameter = Parameter.CreateProjectParameter(checkIfParameterExist.out1, code_block_22.out1, select_parameter_type, parameter_groups, boolean_2, categories_3)

# group: Query Revit for spaces
categories_4 = Categories("MEPSpaces")
passthrough = Custom[Passthrough](passThrough=categories_4, waitFor=createProjectParameter)  # Forces a sequential order of execution. The node wired into the output of the Passthrough node will be executed *after* the node wired into the waitFor input (e.g. important for some Revit operations). The value of the passThrough input will be passed on to the node wired into the output port of the Passthrough node.
all_elements_of_category_3 = ElementsOfCategory(passthrough)
code_block_23 = CodeBlock()
# ---------- code_block_23.designscript (3 lines) ----------
{"space_URI","Name","Number","revit_UUID","storeyOfSpace_URI"};
 //needs cross product
 //empty parameter value => empty string
# ----------------------------------------
getParameterValueByName_3 = Element.GetParameterValueByName(element=all_elements_of_category_3, parameterName=code_block_23, lacing=CrossProduct)

compare_revit_spaces_with_graph = Custom[Compare revit spaces with graph spaces](settings=ui_multipleinputform.User_Inputs, graph_spaces=getValueByKey_2, revit_spaces=getParameterValueByName_3)

# group: Modify - Delete - create Revit spaces according to Linked Data input
replace_nulls_in_graph_list = Python(IN[0]=getValueByKey_2)
# ---------- replace_nulls_in_graph_list.python (14 lines) ----------
import clr

#The inputs to this node will be stored as a list in the IN variables.
startList = IN[0]

#element = startList[4]
for sublist in startList:
	if sublist[1] is None:
		sublist[1] = "No value in graph" #space name
	if sublist[2] is None:
		sublist[2] = "No value in graph"

#Assign your output to the OUT variable.
OUT = startList
# ----------------------------------------
filterByBoolMask = List.FilterByBoolMask(list=all_elements_of_category_3, mask=compare_revit_spaces_with_graph.Revit_to_delete)
filterByBoolMask_2 = List.FilterByBoolMask(list=all_elements_of_category_3, mask=compare_revit_spaces_with_graph.Revit_to_modify_name)
code_block_24 = CodeBlock { "Name"; }
setParameterByName = Element.SetParameterByName(element=filterByBoolMask_2.in, parameterName=code_block_24, value=compare_revit_spaces_with_graph.Revit_new_names)
filterByBoolMask_3 = List.FilterByBoolMask(list=all_elements_of_category_3, mask=compare_revit_spaces_with_graph.Revit_to_modify_number)
code_block_25 = CodeBlock { "Number"; }
setParameterByName_2 = Element.SetParameterByName(element=filterByBoolMask_3.in, parameterName=code_block_25, value=compare_revit_spaces_with_graph.Revit_new_numbers)
code_block_26 = CodeBlock { 1; 2; }

# group: Modify space levels according to Linked Data input
filterByBoolMask_4 = List.FilterByBoolMask(list=all_elements_of_category_3, mask=compare_revit_spaces_with_graph.Revit_to_modify_space_Level_delete)
passthrough2 = Custom[Passthrough2](passThrough=filterByBoolMask_4.in, waitFor1=setParameterByName, waitFor2=setParameterByName_2)  # Forces a sequential order of execution. The node wired into the output of the Passthrough node will be executed *after* the node wired into the waitFor input (e.g. important for some Revit operations). The value of the passThrough input will be passed on to the node wired into the output port of the Passthrough node.
delete = Archilab.Grimshaw.Elements.Element.Delete(passthrough2)
passthrough_2 = Custom[Passthrough](passThrough=compare_revit_spaces_with_graph.Revit_to_modify_space_Level_create, waitFor=delete)
replace_nulls_in_graph_list_2 = Python(IN[0]=passthrough_2)  # same code as replace_nulls_in_graph_list
transpose = List.Transpose(replace_nulls_in_graph_list_2)
count = Count(passthrough_2)
code_block_27 = CodeBlock { 1; 2; }
getItemAtIndex = List.GetItemAtIndex(list=transpose, index=code_block_27.out0)
getItemAtIndex_2 = List.GetItemAtIndex(list=transpose, index=code_block_27.out1)

# group: Create spaces in Revit
code_block_28 = CodeBlock { 4; }
getItemAtIndex_3 = List.GetItemAtIndex(list=transpose, index=code_block_28)
categories_5 = Categories("Levels")
all_elements_of_category_4 = ElementsOfCategory(categories_5)
code_block_29 = CodeBlock { "storey_URI"; }
getParameterValueByName_4 = Element.GetParameterValueByName(element=all_elements_of_category_4, parameterName=code_block_29)
find_levels_from_storey_uris = Python(IN[0]=getItemAtIndex_3, IN[1]=all_elements_of_category_4, IN[2]=getParameterValueByName_4)
# ---------- find_levels_from_storey_uris.python (19 lines) ----------
import clr

#The inputs to this node will be stored as a list in the IN variables.
storeyUris = IN[0]
levels = IN[1]
levelStoreyUris = IN[2]

foundLevels = []

for storeyUri in storeyUris:
	i = 0
	for level in levels:
		if levelStoreyUris[i] == storeyUri:
			foundLevels.append(level)
			break
		i += 1

#Assign your output to the OUT variable.
OUT = foundLevels
# ----------------------------------------
code_block_30 = CodeBlock()
# ---------- code_block_30.designscript (8 lines) ----------
//start point X (mm)
0;
//start point Y (mm)
-15000;
//start point Z (mm)
0;
//x step (mm)
3000;
# ----------------------------------------
increment_x_with_step = Python(IN[0]=code_block_30.out0, IN[1]=code_block_30.out3, IN[2]=count)
# ---------- increment_x_with_step.python (15 lines) ----------
import clr

#The inputs to this node will be stored as a list in the IN variables.
start = IN[0]
step = IN[1]
amount = IN[2]

result = []

for i in range(amount):
	result.append(start)
	start += step

#Assign your output to the OUT variable.
OUT = result
# ----------------------------------------
ofRepeatedItem = List.OfRepeatedItem(item=code_block_30.out1, amount=count)
ofRepeatedItem_2 = List.OfRepeatedItem(item=code_block_30.out2, amount=count)
byCoordinates = Point.ByCoordinates(x=increment_x_with_step, y=ofRepeatedItem, z=ofRepeatedItem_2)
create_revit_spaces = Python(IN[0]=find_levels_from_storey_uris, IN[1]=byCoordinates)
# ---------- create_revit_spaces.python (42 lines) ----------
import clr

#Import DocumentManger
clr.AddReference("RevitServices")
import RevitServices
from RevitServices.Persistence import DocumentManager
from RevitServices.Transactions import TransactionManager

doc = DocumentManager.Instance.CurrentDBDocument

#Import RevitNodes
clr.AddReference("RevitNodes")
import Revit
clr.ImportExtensions(Revit.Elements)

#Import Revit API
clr.AddReference("RevitAPI")
import Autodesk

#Import ToProtoType, ToRevitType geometry conversion extension methods
clr.ImportExtensions(Revit.GeometryConversion)

#The inputs to this node will be stored as a list in the IN variables.
dataEnteringNode = IN
lvls = UnwrapElement(IN[0])
pts = UnwrapElement(IN[1])
uvs = []
spaces = []
for p in pts:
	temp = p.ToRevitType()
	uvs.append(Autodesk.Revit.DB.UV(temp.X,temp.Y))
	
TransactionManager.Instance.EnsureInTransaction(doc)
for i in range(len(uvs)):
	sp = doc.Create.NewSpace(lvls[i],uvs[i])
	spaces.append(sp.ToDSType(False))
TransactionManager.Instance.TransactionTaskDone()

#Assign your output to the OUT variable.
OUT = spaces

#http://dynamobim.org/forums/topic/create-spaces-automatically/#post-12909
# ----------------------------------------

# group: Set space_URI
transpose_2 = List.Transpose(getValueByKey_2)
firstItem_3 = List.FirstItem(transpose_2)
code_block_31 = CodeBlock { "space_URI"; }
setParameterByName_3 = Element.SetParameterByName(element=create_revit_spaces, parameterName=code_block_31, value=firstItem_3)

# group: Set revit_UUID
uniqueId = Element.UniqueId(create_revit_spaces)
code_block_32 = CodeBlock { "revit_UUID"; }
setParameterByName_4 = Element.SetParameterByName(element=create_revit_spaces, parameterName=code_block_32, value=uniqueId)

prepare_for_sparql_values_revit = Python(IN[0]=firstItem_3, IN[1]=uniqueId)  # "Prepare for SPARQL VALUES (revit_uuid)"
# ---------- prepare_for_sparql_values_revit.python (13 lines) ----------
import clr

#The inputs to this node will be stored as a list in the IN variables.
uris = IN[0]
uuids = IN[1]

urisAndUuids = ""

for i in range(len(uris)):
	urisAndUuids = urisAndUuids + '\n' + "(<" + uris[i] + "> \"" + uuids[i] + "\" )"

#Assign your output to the OUT variable.
OUT = urisAndUuids
# ----------------------------------------

# group: Control queries via settings
code_block_33 = CodeBlock(OUT=ui_multipleinputform.User_Inputs) { OUT[0]; OUT[1]; OUT[3]; OUT[4]; OUT[5]; OUT[6]; }
code_block_34 = CodeBlock { false; true; }
if_ = If(test=code_block_33.out0, true=code_block_34.out0, false=code_block_34.out1)
and_ = And(code_block_33.out3, if_)
and_2 = And(code_block_33.out4, if_)
and_3 = And(code_block_33.out5, if_)

and_4 = And(code_block_33.out0, code_block_33.out1)

# group: Query graph: write revit_uuid
URL_2 = StringInput("localhost:5820")
user_password_2 = StringInput("admin")
query_2 = StringInput("""PREFIX props: <https://w3id.org/props#>
DELETE {
?spaces props:revit_uuid_simple ?origUuid .
}
INSERT {
?spaces props:revit_uuid_simple ?uuid .
}
WHERE {
?spaces ?p ?o .
OPTIONAL {?spaces props:revit_uuid_simple ?origUuid .}
VALUES (?spaces ?uuid) {<values1>
}
}""")
code_block_35 = CodeBlock { "<values1>"; }
replace_2 = String.Replace(str=query_2, searchFor=code_block_35, replaceWith=prepare_for_sparql_values_revit)
reasoning_2 = BoolSelector(false)
# note: [0]URL
# [1]DB
# [2]user
# [3]pw
# [4]query
# [5]reasoning?
# [6]go?
post_data = Python(IN[0]=URL_2, IN[1]=getParameterValueByName, IN[2]=user_password_2, IN[3]=user_password_2, IN[4]=replace_2, IN[5]=reasoning_2, IN[6]=and_4)
# ---------- post_data.python (51 lines) ----------
import clr
import sys
sys.path.append('C:\Program Files (x86)\IronPython 2.7\Lib')
import httplib, urllib, json, base64, time

clr.AddReference('ProtoGeometry')
from Autodesk.DesignScript.Geometry import *
#The inputs to this node will be stored as a list in the IN variables.
url = IN[0]
db = IN[1]
user = IN[2]
password = IN[3]
query = IN[4]
reasoning = IN[5]
go = IN[6]

if go:
	
    #DB CONNECTION
	
    # Establish connection
	conn = httplib.HTTPConnection(url)
	
    # Encode username and password in base64
	encodedAuth = base64.b64encode('%s:%s' % (user, password))
	
    # Define headers for authorizatio etc.
	headers = {"authorization": ("Basic %s" % encodedAuth), "Content-type": "application/x-www-form-urlencoded", "Accept": "text/boolean"}
	
    # Define parameters (qyery, reasoning etc.)
	body = 'query=%s' % query
   	#body = urlencode({"query": query, "reasoning": reasoning})
   	#params = urllib.urlencode({"query": query, "reasoning": reasoning})
	
    # Send request
	conn.request('POST', '/'+ db +'/update', body, headers)
	
    # Get response
	response = conn.getresponse()
	
    # Read response
	data = response.status, response.reason
	
    # Close db connection
	conn.close()

else:
	data = "off mode"

#Assign your output to the OUT variable.
OUT = data
# ----------------------------------------
watch = Watch(post_data)

# group (continued): Modify - Delete - create Revit spaces according to Linked Data input
passthrough_3 = Custom[Passthrough](passThrough=filterByBoolMask.in, waitFor=watch)
delete_2 = Archilab.Grimshaw.Elements.Element.Delete(passthrough_3)
passthrough_4 = Custom[Passthrough](passThrough=compare_revit_spaces_with_graph.Revit_to_create, waitFor=delete_2)
filterByBoolMask_5 = List.FilterByBoolMask(list=replace_nulls_in_graph_list, mask=passthrough_4)
transpose_3 = List.Transpose(filterByBoolMask_5.in)
countTrue = CountTrue(passthrough_4)
getItemAtIndex_4 = List.GetItemAtIndex(list=transpose_3, index=code_block_26.out0)
getItemAtIndex_5 = List.GetItemAtIndex(list=transpose_3, index=code_block_26.out1)

# group: Start location and step of new spaces
separate_and_cast_coordinates = Python(IN[0]=ui_multipleinputform.User_Inputs)
# ---------- separate_and_cast_coordinates.python (8 lines) ----------
import clr

#The inputs to this node will be stored as a list in the IN variables.
inputs = IN[0]
inputs = [int(inputs[9]),int(inputs[10]),inputs[11]]

#Assign your output to the OUT variable.
OUT = inputs
# ----------------------------------------
firstItem_4 = List.FirstItem(separate_and_cast_coordinates)
lastItem = List.LastItem(separate_and_cast_coordinates)
code_block_36 = CodeBlock { 1; }
getItemAtIndex_6 = List.GetItemAtIndex(list=separate_and_cast_coordinates, index=code_block_36)

code_block_37 = CodeBlock { 0; }

# group: Create spaces in Revit
code_block_38 = CodeBlock { 4; }
getItemAtIndex_7 = List.GetItemAtIndex(list=transpose_3, index=code_block_38)
categories_6 = Categories("Levels")
all_elements_of_category_5 = ElementsOfCategory(categories_6)
code_block_39 = CodeBlock { "storey_URI"; }
getParameterValueByName_5 = Element.GetParameterValueByName(element=all_elements_of_category_5, parameterName=code_block_39)
find_levels_from_storey_uris_2 = Python(IN[0]=getItemAtIndex_7, IN[1]=all_elements_of_category_5, IN[2]=getParameterValueByName_5)
# ---------- find_levels_from_storey_uris_2.python (19 lines) ----------
import clr

#The inputs to this node will be stored as a list in the IN variables.
storeyUris = IN[0]
levels = IN[1]
levelStoreyUris = IN[2]

foundLevels = []

for storeyUri in storeyUris:
	k = 0
	for level in levels:
		if levelStoreyUris[k] == storeyUri:
			foundLevels.append(level)
			break
		k += 1

#Assign your output to the OUT variable.
OUT = foundLevels
# ----------------------------------------
increment_x_with_step_2 = Python(IN[0]=firstItem_4, IN[1]=lastItem, IN[2]=countTrue)  # same code as increment_x_with_step
ofRepeatedItem_3 = List.OfRepeatedItem(item=getItemAtIndex_6, amount=countTrue)
ofRepeatedItem_4 = List.OfRepeatedItem(item=code_block_37, amount=countTrue)
byCoordinates_2 = Point.ByCoordinates(x=increment_x_with_step_2, y=ofRepeatedItem_3, z=ofRepeatedItem_4)
create_revit_spaces_2 = Python(IN[0]=find_levels_from_storey_uris_2, IN[1]=byCoordinates_2)  # same code as create_revit_spaces

# group: Set space_URI
code_block_40 = CodeBlock { "space_URI"; }
transpose_4 = List.Transpose(getValueByKey_2)
firstItem_5 = List.FirstItem(transpose_4)
setParameterByName_5 = Element.SetParameterByName(element=create_revit_spaces_2, parameterName=code_block_40, value=firstItem_5)

# group: Set revit_UUID
code_block_41 = CodeBlock { "revit_UUID"; }
uniqueId_2 = Element.UniqueId(create_revit_spaces_2)
setParameterByName_6 = Element.SetParameterByName(element=create_revit_spaces_2, parameterName=code_block_41, value=uniqueId_2)

code_block_42 = CodeBlock(OUT=ui_multipleinputform.User_Inputs) { OUT[7]; OUT[8]; }
prepare_for_sparql_insert_data = Python(IN[0]=firstItem_5, IN[1]=uniqueId_2)  # "Prepare for SPARQL INSERT DATA (revit_uuid)"
# ---------- prepare_for_sparql_insert_data.python (13 lines) ----------
import clr

#The inputs to this node will be stored as a list in the IN variables.
uris = IN[0]
uuids = IN[1]

urisAndUuids = ""

for i in range(len(uris)):
	urisAndUuids = urisAndUuids + '\n' + "( <" + uris[i] + "> \"" + uuids[i] + "\" )"

#Assign your output to the OUT variable.
OUT = urisAndUuids
# ----------------------------------------
and_5 = And(code_block_33.out0, code_block_33.out2)

# group: Query graph: write revit_uuid
URL_3 = StringInput("localhost:5820")
user_password_3 = StringInput("admin")
query_3 = StringInput("""PREFIX props: <https://w3id.org/props#>
DELETE {
?spaces props:revit_uuid_simple ?origUuid .
}
INSERT {
?spaces props:revit_uuid_simple ?uuid .
}
WHERE {
?spaces ?p ?o .
OPTIONAL {?spaces props:revit_uuid_simple ?origUuid .}
VALUES (?spaces ?uuid) {<values1>
}
}""")
code_block_43 = CodeBlock { "<values1>"; }
replace_3 = String.Replace(str=query_3, searchFor=code_block_43, replaceWith=prepare_for_sparql_insert_data)
reasoning_3 = BoolSelector(false)
# note: [0]URL
# [1]DB
# [2]user
# [3]pw
# [4]query
# [5]reasoning?
# [6]go?
post_data_2 = Python(IN[0]=URL_3, IN[1]=getParameterValueByName, IN[2]=user_password_3, IN[3]=user_password_3, IN[4]=replace_3, IN[5]=reasoning_3, IN[6]=and_5)  # same code as post_data
watch_2 = Watch(post_data_2)

# group: Data processing for modifying graph spaces
filterByBoolMask_6 = List.FilterByBoolMask(list=getValueByKey_2, mask=compare_revit_spaces_with_graph.Graph_to_modify)
transpose_5 = List.Transpose(filterByBoolMask_6.in)
firstItem_6 = List.FirstItem(transpose_5)
prepare_for_sparql_values = Python(IN[0]=firstItem_6, IN[1]=compare_revit_spaces_with_graph.Graph_new_names, IN[2]=compare_revit_spaces_with_graph.Graph_new_numbers)  # "Prepare for SPARQL VALUES <storeyMod>"
# ---------- prepare_for_sparql_values.python (14 lines) ----------
import clr

#The inputs to this node will be stored as a list in the IN variables.
uris = IN[0]
names = IN[1]
numbers = IN[2]

spacesMod = ""

for i in range(len(uris)):
	spacesMod = spacesMod + '\n' + "( <" + uris[i] + "> \"" + names[i] + "\" \"" + numbers[i] + "\" )"

#Assign your output to the OUT variable.
OUT = spacesMod
# ----------------------------------------

# group: Query graph: modify storeys
URL_4 = StringInput("localhost:5820")
user_password_4 = StringInput("admin")
query_4 = StringInput("""PREFIX props: <https://w3id.org/props#>
DELETE {
?spaces props:name_simple ?origName ;
 props:number_simple ?origNumber .
}
INSERT {
?spaces props:name_simple ?names ;
 props:number_simple ?numbers.
}
WHERE {
?spaces ?p ?o .
OPTIONAL { ?spaces props:name_simple ?origName }
OPTIONAL { ?spaces props:number_simple ?origNumber }
VALUES (?spaces ?names ?numbers) {<spacesMod>
}
}""")
code_block_44 = CodeBlock { "<spacesMod>"; }
replace_4 = String.Replace(str=query_4, searchFor=code_block_44, replaceWith=prepare_for_sparql_values)
reasoning_4 = BoolSelector(false)
# note: [0]URL
# [1]DB
# [2]user
# [3]pw
# [4]query
# [5]reasoning?
# [6]go?
post_data_3 = Python(IN[0]=URL_4, IN[1]=getParameterValueByName, IN[2]=user_password_4, IN[3]=user_password_4, IN[4]=replace_4, IN[5]=reasoning_4, IN[6]=and_)  # same code as post_data
watch_3 = Watch(post_data_3)

# group: Control lists manually
watch_4 = Watch(getParameterValueByName_3)
watch_5 = Watch(getValueByKey_2)

# group: Data processing for deleting spaces
filterByBoolMask_7 = List.FilterByBoolMask(list=getValueByKey_2, mask=compare_revit_spaces_with_graph.Graph_to_delete)
transpose_6 = List.Transpose(filterByBoolMask_7.in)
firstItem_7 = List.FirstItem(transpose_6)
prepare_for_sparql_values_2 = Python(IN[0]=firstItem_7)  # "Prepare for SPARQL VALUES <spacesDel>"
# ---------- prepare_for_sparql_values_2.python (12 lines) ----------
import clr

#The inputs to this node will be stored as a list in the IN variables.
uris = IN[0]

spacesDel = ""

for i in range(len(uris)):
	spacesDel = spacesDel + '\n' + " <" + uris[i] + ">"

#Assign your output to the OUT variable.
OUT = spacesDel
# ----------------------------------------

# group: Query graph: delete storeys
URL_5 = StringInput("localhost:5820")
user_password_5 = StringInput("admin")
query_5 = StringInput("""PREFIX props: <https://w3id.org/props#>
DELETE {
?spaces ?p1 ?o .
?s ?p2 ?spaces .
}
WHERE {
?spaces ?p1 ?o .
OPTIONAL {?s ?p2 ?spaces }
VALUES ?spaces {<spacesDel>
 }
}""")
code_block_45 = CodeBlock { "<spacesDel>"; }
replace_5 = String.Replace(str=query_5, searchFor=code_block_45, replaceWith=prepare_for_sparql_values_2)
reasoning_5 = BoolSelector(true)
# note: [0]URL
# [1]DB
# [2]user
# [3]pw
# [4]query
# [5]reasoning?
# [6]go?
post_data_4 = Python(IN[0]=URL_5, IN[1]=getParameterValueByName, IN[2]=user_password_5, IN[3]=user_password_5, IN[4]=replace_5, IN[5]=reasoning_5, IN[6]=and_2)
# ---------- post_data_4.python (50 lines) ----------
import clr
import sys
sys.path.append('C:\Program Files (x86)\IronPython 2.7\Lib')
import httplib, urllib, json, base64, time

clr.AddReference('ProtoGeometry')
from Autodesk.DesignScript.Geometry import *
#The inputs to this node will be stored as a list in the IN variables.
url = IN[0]
db = IN[1]
user = IN[2]
password = IN[3]
query = IN[4]
reasoning = IN[5]
go = IN[6]

if go:
	
    #DB CONNECTION
	
    # Establish connection
	conn = httplib.HTTPConnection(url)
	
    # Encode username and password in base64
	encodedAuth = base64.b64encode('%s:%s' % (user, password))
	
    # Define headers for authorizatio etc.
	headers = {"authorization": ("Basic %s" % encodedAuth), "Content-type": "application/x-www-form-urlencoded", "Accept": "text/boolean"}
	
    # Define parameters (query, reasoning etc.)
	#body = 'query=%s' % query
   	body = urllib.urlencode({"query": query, "reasoning": reasoning})
	
    # Send request
	conn.request('POST', '/'+ db +'/update', body, headers)
	
    # Get response
	response = conn.getresponse()
	
    # Read response
	data = response.status, response.reason
	
    # Close db connection
	conn.close()

else:
	data = "off mode"

#Assign your output to the OUT variable.
OUT = data
# ----------------------------------------
watch_6 = Watch(post_data_4)

# group: Get space name and number
filterByBoolMask_8 = List.FilterByBoolMask(list=getParameterValueByName_3, mask=compare_revit_spaces_with_graph.Graph_to_create)
transpose_7 = List.Transpose(filterByBoolMask_8.in)
code_block_46 = CodeBlock()
# ---------- code_block_46.designscript (4 lines) ----------
//name
1;
//number
2;
# ----------------------------------------
getItemAtIndex_8 = List.GetItemAtIndex(list=transpose_7, index=code_block_46.out0)
getItemAtIndex_9 = List.GetItemAtIndex(list=transpose_7, index=code_block_46.out1)

# group: Data processing for creating new spaces
filterByBoolMask_9 = List.FilterByBoolMask(list=all_elements_of_category_3, mask=compare_revit_spaces_with_graph.Graph_to_create)

# group: Set revit_UUID
code_block_47 = CodeBlock { "revit_UUID"; }
uniqueId_3 = Element.UniqueId(filterByBoolMask_9.in)
setParameterByName_7 = Element.SetParameterByName(element=filterByBoolMask_9.in, parameterName=code_block_47, value=uniqueId_3)

# group: URI generator
count_2 = Count(filterByBoolMask_9.in)
uri_generator = Custom[URI generator](URI_base=code_block_42.out0, number_of_URIs_needed=count_2, Optional_string_after_URI_base=code_block_42.out1)  # Creates a URI based on a base, optional string and a random uuid

# group: Set space_URI
code_block_48 = CodeBlock { "space_URI"; }
setParameterByName_8 = Element.SetParameterByName(element=filterByBoolMask_9.in, parameterName=code_block_48, value=uri_generator)

# group: Get storey_URI of Level of space
code_block_49 = CodeBlock { "Level"; }
getParameterValueByName_6 = Element.GetParameterValueByName(element=filterByBoolMask_9.in, parameterName=code_block_49)
get_level_by_name = Custom[Get Level by Name](Level_Name=getParameterValueByName_6, lacing=Longest)  # This node will retrieve a Revit Level Element by its name.
code_block_50 = CodeBlock { "storey_URI"; }
getParameterValueByName_7 = Element.GetParameterValueByName(element=get_level_by_name, parameterName=code_block_50)

# group (continued): Data processing for creating new spaces
prepare_for_sparql_values_3 = Python(IN[0]=uri_generator, IN[1]=getItemAtIndex_8, IN[2]=getItemAtIndex_9, IN[3]=uniqueId_3, IN[4]=getParameterValueByName_7)  # "Prepare for SPARQL VALUES <storeyCrea>"
# ---------- prepare_for_sparql_values_3.python (16 lines) ----------
import clr

#The inputs to this node will be stored as a list in the IN variables.
uris = IN[0]
names = IN[1]
numbers = IN[2]
uuids = IN[3]
storeys = IN[4]

spacesCrea = ""

for i in range(len(uris)):
	spacesCrea = spacesCrea + '\n' + "( <" + uris[i] + "> \"" + names[i] + "\" \"" + numbers[i] + "\" \"" + uuids[i] + "\" <" + storeys[i] + "> )"

#Assign your output to the OUT variable.
OUT = spacesCrea
# ----------------------------------------

# group: Query graph: create storeys
URL_6 = StringInput("localhost:5820")
user_password_6 = StringInput("admin")
query_6 = StringInput("""PREFIX props: <https://w3id.org/props#>
PREFIX bot: <https://w3id.org/bot#>
INSERT {
?storeys bot:hasSpace ?spaces .
?spaces props:name_simple ?names ;
 props:number_simple ?numbers ;
 props:revit_uuid_simple ?uuid .
}
WHERE {
VALUES (?spaces ?names ?numbers ?uuid ?storeys) {<spacesCrea>
 } 
}""")
code_block_51 = CodeBlock { "<spacesCrea>"; }
replace_6 = String.Replace(str=query_6, searchFor=code_block_51, replaceWith=prepare_for_sparql_values_3)
reasoning_6 = BoolSelector(false)
# note: [0]URL
# [1]DB
# [2]user
# [3]pw
# [4]query
# [5]reasoning?
# [6]go?
post_data_5 = Python(IN[0]=URL_6, IN[1]=getParameterValueByName, IN[2]=user_password_6, IN[3]=user_password_6, IN[4]=replace_6, IN[5]=reasoning_6, IN[6]=and_3)  # same code as post_data
watch_7 = Watch(post_data_5)

# group: Set space name and number
code_block_52 = CodeBlock { "Name"; "Number"; }
setParameterByName_9 = Element.SetParameterByName(element=create_revit_spaces_2, parameterName=code_block_52.out0, value=getItemAtIndex_4)
setParameterByName_10 = Element.SetParameterByName(element=create_revit_spaces_2, parameterName=code_block_52.out1, value=getItemAtIndex_5)

# group: Set space name and number
code_block_53 = CodeBlock { "Name"; "Number"; }
setParameterByName_11 = Element.SetParameterByName(element=create_revit_spaces, parameterName=code_block_53.out0, value=getItemAtIndex)
setParameterByName_12 = Element.SetParameterByName(element=create_revit_spaces, parameterName=code_block_53.out1, value=getItemAtIndex_2)

compare_revit_spaces_with_graph_2 = Python(IN[0]=ui_multipleinputform.User_Inputs, IN[1]=getValueByKey_2, IN[2]=getParameterValueByName_3)  # "Compare revit spaces with graph spaces"
# ---------- compare_revit_spaces_with_graph_2.python (118 lines) ----------
import clr

#The inputs to this node will be stored as a list in the IN variables.
settings = IN[0]
graphList = IN[1]
revitList = IN[2] # can be empty

# variables
revitModifyName = [] #revitList can be empty
revitNewNames = []
revitModifyNumber = [] #revitList can be empty
revitNewNumbers = []
revitDeleteSpaceLevels = [] #revitList can be empty
revitCreateSpaceLevels = []
revitDelete = [] #revitList can be empty
revitCreate = [False] * len(graphList)

graphModify = [False] * len(graphList)
graphNewNames = []
graphNewNumbers = []
graphDelete = [False] * len(graphList)
graphCreate = [] #revitList can be empty

###########################################
if settings[0]: #graph to Revit
	if settings[1] and revitList is not None: #modify Revit spaces? (revitList can be empty)
		revitModifyName = [False] * len(revitList)
		revitModifyNumber = [False] * len(revitList)
		revitDeleteSpaceLevels = [False] * len(revitList)
		i = -1
		for revitEl in revitList:
			i += 1
			if revitEl[0] == "": #space has space_URI value?
				continue #if empty, there is no corresponding space to be found
			for graphEl in graphList:
				if revitEl[0] == graphEl[0]: #URI of space corresponds to entity of graph?
					if graphEl[1] is not None:
						revitModifyName[i] = True
						revitNewNames.append(graphEl[1])
					if graphEl[2] is not None:
						revitModifyNumber[i] = True
						revitNewNumbers.append(graphEl[2])
					if graphEl[4] != revitEl[4]: #control Level of Revit Space
						revitDeleteSpaceLevels[i] = True # needed to delete spaces (modify levels of spaces)
						revitCreateSpaceLevels.append(graphEl) # needed to create spaces (modify levels of spaces)
					break #if the corresponding element is found, the comparison can stop					
	
	if settings[2] and revitList is not None: #delete Revit spaces? (revitList can be empty)
		revitDelete = [True] * len(revitList)
		i = -1
		for revitEl in revitList:
			i += 1
			if revitEl[0] == "": #space has space_URI value?
				continue #if empty, there is no corresponding space to be found
			for graphEl in graphList:
				if revitEl[0] == graphEl[0]:
					revitDelete[i] = False
					break
				
	if settings[3]: #create new Revit spaces?
		if revitList is None: #(revitList can be empty)
			revitCreate = [True] * len(graphList)
		else:
			i = -1
			for graphEl in graphList:
				i += 1
				if graphEl[3] is None: #space has value for revit_uuid_simple? 
					revitCreate[i] = True
					continue
				for revitEl in revitList:
					if graphEl[0] == revitEl[0]: #URI of space corresponds to Revit space URI?
						revitCreate[i] = False
						break
					else: revitCreate[i] = True
###########################################
else: #Revit to graph
	if settings[4]: #modify graph Space entities?
		i = -1
		for graphEl in graphList:
			i += 1
			if graphEl[3] is None or revitList is None: #space has revit_uuid_simple value? (revitList can be empty)
				continue #if empty, there is no corresponding space to be found
			for revitEl in revitList:
				if revitEl[0] == graphEl[0]: #URI of space corresponds to entity of graph?
					graphModify[i] = True
					graphNewNames.append(revitEl[1])
					graphNewNumbers.append(revitEl[2])
					break #if the corresponding element is found, the comparison can stop	
	
	if settings[5]: #delete graph Space entities?
		graphDelete = [True] * len(graphList)
		if revitList is not None: #revitList can be empty
			i = -1
			for graphEl in graphList:
				i += 1
				if graphEl[3] is None: #space has revit_uuid_simple value?
					continue #if empty, there is no corresponding space to be found
				for revitEl in revitList:
					if revitEl[0] == graphEl[0]:
						graphDelete[i] = False
						break
	
	if settings[6]: #create new graph Space entities?
		if revitList is not None: #revitList can be empty
			graphCreate = [False] * len(revitList)
			i = -1
			for revitEl in revitList:
				i += 1
				if revitEl[0] == "": #space has value for storey_URI?
					graphCreate[i] = True
					continue
				for graphEl in graphList:
					if graphEl[0] == revitEl[0]: #URI of space corresponds to Revit space URI?
						graphCreate[i] = False
						break
					else: graphCreate[i] = True
###########################################
OUT = [revitModifyName,revitNewNames,revitModifyNumber,revitNewNumbers,revitDeleteSpaceLevels,revitCreateSpaceLevels,revitDelete,revitCreate,graphModify,graphNewNames,graphNewNumbers,graphDelete,graphCreate]
# ----------------------------------------
code_block_54 = CodeBlock(OUT=compare_revit_spaces_with_graph_2) { OUT[0]; OUT[1]; OUT[2]; OUT[3]; OUT[4]; OUT[5]; OUT[6]; OUT[7]; OUT[8]; OUT[9]; OUT[10]; OUT[11]; OUT[12]; }
