# Dynamo graph PART4 - elements.dyn (Dynamo 1.3.3.4651)

# group: Revit categories related to elements
categories_list = Custom[Categories list]()  # Gives list of all Revit categories and a matching list of their names
natural_sort_list_of_strings = Custom[Natural Sort List of Strings](listOfStrings=categories_list.Category_name_s)
code_block = CodeBlock { {"analy","Tags","Annot","view","legend","symbol","grid","line","reference"}; }
code_block_2 = CodeBlock { {"point","area","zone","space","room","boundar","callout","label","coord"}; }
code_block_3 = CodeBlock { {"detail","path","dimens","color","elevation","region","import","level"}; }
code_block_4 = CodeBlock { {"material","graphics","project","image","set toggle","cloud","link","schedule"}; }
code_block_5 = CodeBlock { {"section","scope","sheet","site","spot","number","load","text","title","topography"}; }
code_block_6 = CodeBlock { {"rebar shape"}; }
create = List.Create(code_block, code_block_2, code_block_3, code_block_4, code_block_5, code_block_6)
flatten = Flatten(create)
code_block_7 = CodeBlock { true; }
contains = String.Contains(str=natural_sort_list_of_strings, searchFor=flatten, ignoreCase=code_block_7, lacing=CrossProduct)
flatten_2 = Flatten()  # unwired: arg0
map = List.Map(list=contains, f_x=flatten_2)
code_block_8 = CodeBlock { true; }
contains_2 = Contains(arg1=code_block_8)  # unwired: arg0
map_2 = List.Map(list=map, f_x=contains_2)
filterByBoolMask = List.FilterByBoolMask(list=natural_sort_list_of_strings, mask=map_2)
byName = Category.ByName(filterByBoolMask.out)
removeNulls = Lists.Manage.RemoveNulls(byName)

# group: Element URIs (internal: also shared parameter)
code_block_9 = CodeBlock { "element_URI"; "Revit UUIDs and graph URIs"; }
checkIfParameterExist = ElementTools.Parameters.CheckIfParameterExist(code_block_9.out0)
select_parameter_type = ParameterType("URL")
parameter_groups = ParameterGroupUi("PG_IDENTITY_DATA")
# note: Identical results as parameter.createSharedParamater
boolean = BoolSelector(true)
createProjectParameter = Parameter.CreateProjectParameter(checkIfParameterExist.out1, code_block_9.out1, select_parameter_type, parameter_groups, boolean, removeNulls)

# group: Find stardog_db of Revit file
categories = Categories("ProjectInformation")
all_elements_of_category = ElementsOfCategory(categories)
firstItem = List.FirstItem(all_elements_of_category)
code_block_10 = CodeBlock { "stardog_db"; }
getParameterValueByName = Element.GetParameterValueByName(element=firstItem, parameterName=code_block_10)

# group: Find building_URI of Revit file
categories_2 = Categories("ProjectInformation")
all_elements_of_category_2 = ElementsOfCategory(categories_2)
firstItem_2 = List.FirstItem(all_elements_of_category_2)
code_block_11 = CodeBlock { "building_URI"; }
getParameterValueByName_2 = Element.GetParameterValueByName(element=firstItem_2, parameterName=code_block_11)

# group: Query graph: storeys
URL = StringInput("localhost:5820")
user_password = StringInput("admin")
query = StringInput("""PREFIX bot: <https://w3id.org/bot#>
PREFIX product: <https://w3id.org/product>
PREFIX props: <https://w3id.org/props#>
SELECT DISTINCT ?element ?uuid (GROUP_CONCAT(DISTINCT ?productClass) AS ?productClasses) ?storey ?storeyName ?storeyElev ?spaceCont ?spaceContName ?spaceContNumber (GROUP_CONCAT(DISTINCT ?spaceAdj) AS ?spaceAdjs) (GROUP_CONCAT(DISTINCT ?spaceAdjDescr;separator=",") AS ?spaceAdjsDescrs)
WHERE {
<building> bot:hasStorey ?storey .
?storey bot:containsElement|bot:adjacentElement ?element .
OPTIONAL {
?storey props:name_simple ?storeyName . 
}
OPTIONAL {
?storey props:elevation_simple ?storeyElev . 
}
OPTIONAL { 
?element props:revit_uuid_simple ?uuid .
}
OPTIONAL {
?element a ?productClass .
FILTER (STRSTARTS(STR(?productClass),STR(product:)))
}
OPTIONAL {
?spaceCont bot:containsElement ?element ;
 a bot:Space .
 OPTIONAL {
 ?spaceCont props:name_simple ?spaceContName . }
 OPTIONAL {
 ?spaceCont 
props:number_simple ?spaceContNumber . }
}
OPTIONAL {
?spaceAdj bot:adjacentElement ?element ;
 a bot:Space .
 OPTIONAL {
 ?spaceAdj props:name_simple  ?spaceAdjName1 . }
 OPTIONAL {
 ?spaceAdj props:number_simple ?spaceAdjNumber1 . }
BIND( IF (EXISTS {?spaceAdj props:name_simple ?spaceAdjName1},?spaceAdjName1,"undefined") AS ?spaceAdjName )
BIND( IF (EXISTS {?spaceAdj props:number_simple ?spaceAdjNumber1},?spaceAdjNumber1,"undefined") AS ?spaceAdjNumber )
BIND( CONCAT( ?spaceAdjName, " (",?spaceAdjNumber,")" ) AS ?spaceAdjDescr )
}
}
GROUP BY ?element ?uuid ?storey ?storeyName ?storeyElev ?spaceCont ?spaceContName ?spaceContNumber
ORDER BY ?element""")
code_block_12 = CodeBlock { "building"; }
replace = String.Replace(str=query, searchFor=code_block_12, replaceWith=getParameterValueByName_2)
reasoning = BoolSelector(true)
go = BoolSelector(true)
# note: url = IN[0]
# db = IN[1]
# user = IN[2]
# password = IN[3]
# query = IN[4]
# reasoning = IN[5]
# go = IN[6]
sparql_get = Python(IN[0]=URL, IN[1]=getParameterValueByName, IN[2]=user_password, IN[3]=user_password, IN[4]=replace, IN[5]=reasoning, IN[6]=go)
# ---------- sparql_get.python (52 lines) ----------
import clr
import sys
sys.path.append('C:\Program Files (x86)\IronPython 2.7\Lib')
import httplib, urllib, base64, json

clr.AddReference('ProtoGeometry')
from Autodesk.DesignScript.Geometry import *
#The inputs to this node will be stored as a list in the IN variables.
url = IN[0]
db = IN[1]
user = IN[2]
password = IN[3]
query = IN[4]
reasoning = IN[5]
go = IN[6]

if go:

	# Defaults
	if not reasoning: reasoning = False
	
	# DB CONNECTION
	
	# Establish connection
	conn = httplib.HTTPConnection(url)
	
	# Encode username and password in base64
	encodedAuth = base64.b64encode('%s:%s' % (user, password))
	
	# Define headers for authorizatio etc.
	headers = {"authorization": ("Basic %s" % encodedAuth), "Content-type": "application/x-www-form-urlencoded", "Accept": "application/sparql-results+json"}
	
	# Define parameters (qyery, reasoning etc.)
	params = urllib.urlencode({"query": query, "reasoning": reasoning})
	
	# Send request
	conn.request('GET', '/'+ db +'/query', params, headers)
	
	# Get response
	response = conn.getresponse()
	
	# Read response
	data = response.read()
	
	# Close db connection
	conn.close()

else:
	data = 'off mode'
	
#Assign your output to the OUT variable.
OUT = data
# ----------------------------------------

# group: JSON handling
string = JsonData.Utilities.Parse.String(sparql_get)
string_2 = StringInput("results.bindings")
getValueByKey = JsonData.Elements.JsonObject.GetValueByKey(string, string_2)
code_block_13 = CodeBlock { {"element.value","uuid.value","productClasses.value","storey.value","storeyName.value","storeyElev.value","spaceCont.value","spaceContName.value","spaceContNumber.value","spaceAdjs.value","spaceAdjsDescrs.value"}; }
getValueByKey_2 = JsonData.Elements.JsonObject.GetValueByKey(getValueByKey, code_block_13, lacing=CrossProduct)

# group: Create sublists wherever needed (2-9-10-11)
transpose = List.Transpose(getValueByKey_2)
firstItem_3 = List.FirstItem(transpose)
code_block_14 = CodeBlock { 2; }
getItemAtIndex = List.GetItemAtIndex(list=transpose, index=code_block_14)
code_block_15 = CodeBlock { " "; }
split = String.Split(arg1=code_block_15)  # unwired: arg0
code_block_16 = CodeBlock { 9; }
getItemAtIndex_2 = List.GetItemAtIndex(list=transpose, index=code_block_16)
code_block_17 = CodeBlock { " "; }
split_2 = String.Split(arg1=code_block_17)  # unwired: arg0
code_block_18 = CodeBlock { 10; }
getItemAtIndex_3 = List.GetItemAtIndex(list=transpose, index=code_block_18)
code_block_19 = CodeBlock { ","; }
split_3 = String.Split(arg1=code_block_19)  # unwired: arg0
code_block_20 = CodeBlock { 11; }
getItemAtIndex_4 = List.GetItemAtIndex(list=transpose, index=code_block_20)
code_block_21 = CodeBlock { ","; }
split_4 = String.Split(arg1=code_block_21)  # unwired: arg0

# group: Check for duplicate elements (not allowed)
sortDuplicateStrings = Lists.Strings.SortDuplicateStrings(firstItem_3)
uniqueItems = List.UniqueItems(firstItem_3)
duplicate_item_indices = Custom[Duplicate Item Indices](List=firstItem_3)  # Searches an input list for duplicate entries and lists their index numbers. Couple with Get From List to delete duplicates from a list.

turn_empty_string_into_null = Python(IN[0]=getItemAtIndex)
# ---------- turn_empty_string_into_null.python (14 lines) ----------
import clr

#The inputs to this node will be stored as a list in the IN variables.
list1 = IN[0]

list2 = []

for el in list1:
	if el == "":
		list2.append(None)
	else: list2.append(el)

#Assign your output to the OUT variable.
OUT = list2
# ----------------------------------------

# group (continued): Create sublists wherever needed (2-9-10-11)
map_3 = List.Map(list=turn_empty_string_into_null, f_x=split)
replaceItemAtIndex = List.ReplaceItemAtIndex(list=transpose, index=code_block_14, item=map_3)

turn_empty_string_into_null_2 = Python(IN[0]=getItemAtIndex_2)  # same code as turn_empty_string_into_null

# group (continued): Create sublists wherever needed (2-9-10-11)
map_4 = List.Map(list=turn_empty_string_into_null_2, f_x=split_2)
replaceItemAtIndex_2 = List.ReplaceItemAtIndex(list=replaceItemAtIndex, index=code_block_16, item=map_4)

turn_empty_string_into_null_3 = Python(IN[0]=getItemAtIndex_3)  # same code as turn_empty_string_into_null

# group (continued): Create sublists wherever needed (2-9-10-11)
map_5 = List.Map(list=turn_empty_string_into_null_3, f_x=split_3)
replaceItemAtIndex_3 = List.ReplaceItemAtIndex(list=replaceItemAtIndex_2, index=code_block_18, item=map_5)
transpose_2 = List.Transpose(replaceItemAtIndex_3)

turn_empty_string_into_null_4 = Python(IN[0]=getItemAtIndex_4)  # same code as turn_empty_string_into_null

# group (continued): Create sublists wherever needed (2-9-10-11)
map_6 = List.Map(list=turn_empty_string_into_null_4, f_x=split_4)
replaceItemAtIndex_4 = List.ReplaceItemAtIndex(list=replaceItemAtIndex_3, index=code_block_20, item=map_6)

string_3 = StringInput("""The selected element is <val>.

Do you want to continue with connecting this Revit element to a Stardog counterpart? 

f the revit element is already connected, the new connection will override the old one.""")
code_block_22 = CodeBlock { "<val>"; }

# group: UI
code_block_23 = CodeBlock { "Connect a Revit element to a graph element"; "GO!"; }
code_block_24 = CodeBlock { "Select one Revit element"; }
code_block_25 = CodeBlock { true; }
ui_selectmodelelements_data = Custom[UI.SelectModelElements Data](ButtonText=code_block_24, CategoryFilter=removeNulls, SelectSingleElement=code_block_25)  # Creates a Revit element selection input for UI.MultipleInputForm++ . Check out www.data-shapes.net for more infos!
boolean_2 = BoolSelector(true)
code_block_26 = CodeBlock { "cancel"; }
ui_multipleinputform = Custom[UI.MultipleInputForm ++](Description_optional=code_block_23.out0, ButtonText_optional=code_block_23.out1, Inputs=ui_selectmodelelements_data, Toggle=boolean_2, CancelButtonText_optional=code_block_26)  # Create a form with multiple inputs. see www.data-shapes.net for tutorials and infos!

# group: Element has empty value for 'element_URI' (= unassigned)?
code_block_27 = CodeBlock { ""; }
code_block_28 = CodeBlock { "element_URI"; }
getParameterValueByName_3 = Element.GetParameterValueByName(element=ui_multipleinputform.User_Inputs, parameterName=code_block_28)
eq = code_block_27 == getParameterValueByName_3
firstItem_4 = List.FirstItem(eq)

code_block_29 = CodeBlock { "UNASSIGNED"; "already ASSIGNED"; }
if_ = If(test=firstItem_4, true=code_block_29.out0, false=code_block_29.out1)
replace_2 = String.Replace(str=string_3, searchFor=code_block_22, replaceWith=if_)

# group: UI
code_block_30 = CodeBlock { "Connect a Revit element to a graph element"; "Continue"; }
ui_textnote_data = Custom[UI.TextNote Data](TextNote=replace_2)  # Create Data for TextNote input in UI.MultipleInputForm ++ . Check out www.data-shapes.net for more informations
boolean_3 = BoolSelector(true)
code_block_31 = CodeBlock { "cancel"; }
code_block_32 = CodeBlock { 800; }

code_block_33 = CodeBlock { "Weights of comparison test"; }

# group: User input: weights via sliders
code_block_34 = CodeBlock()
# ---------- code_block_34.designscript (16 lines) ----------
"TEST1: Graph element already assigned";
1;
"TEST2: Matching product class(es): DIRECT";
2;
"TEST2: Matching product class(es): INDIRECT (superclass1)";
1;
"TEST2: Matching product class(es): INDIRECT (superclass2)";
1/2;
"TEST2: Matching product class(es): INDIRECT (superclass3)";
1/4;
"TEST 3: Matching Storey";
1;
"TEST 4: Matching nearby Revit Levels to Storey";
1/2;
"TEST 5: Matching Space(s)";
2;
# ----------------------------------------
code_block_35 = CodeBlock { 0; 3; 0.1; }
slider = Custom[UI.Slider](InputName=code_block_34.out0, Minimum=code_block_35.out0, Maximum=code_block_35.out1, Default_Value=code_block_34.out1, Step=code_block_35.out2)  # Creates slider input for UI.MultipleInputForm ++ . Set the step to decimal value if you want a double slider, or to a integer value if you want an integer slider.
slider_2 = Custom[UI.Slider](InputName=code_block_34.out2, Minimum=code_block_35.out0, Maximum=code_block_35.out1, Default_Value=code_block_34.out3, Step=code_block_35.out2)
slider_3 = Custom[UI.Slider](InputName=code_block_34.out4, Minimum=code_block_35.out0, Maximum=code_block_35.out1, Default_Value=code_block_34.out5, Step=code_block_35.out2)
slider_4 = Custom[UI.Slider](InputName=code_block_34.out6, Minimum=code_block_35.out0, Maximum=code_block_35.out1, Default_Value=code_block_34.out7, Step=code_block_35.out2)
slider_5 = Custom[UI.Slider](InputName=code_block_34.out8, Minimum=code_block_35.out0, Maximum=code_block_35.out1, Default_Value=code_block_34.out9, Step=code_block_35.out2)
slider_6 = Custom[UI.Slider](InputName=code_block_34.out10, Minimum=code_block_35.out0, Maximum=code_block_35.out1, Default_Value=code_block_34.out11, Step=code_block_35.out2)
slider_7 = Custom[UI.Slider](InputName=code_block_34.out12, Minimum=code_block_35.out0, Maximum=code_block_35.out1, Default_Value=code_block_34.out13, Step=code_block_35.out2)
slider_8 = Custom[UI.Slider](InputName=code_block_34.out14, Minimum=code_block_35.out0, Maximum=code_block_35.out1, Default_Value=code_block_34.out15, Step=code_block_35.out2)

create_2 = List.Create(slider, slider_2, slider_3, slider_4, slider_5, slider_6, slider_7, slider_8)
ui_inputgroup_data = Custom[UI.InputGroup Data](GroupTitle=code_block_33, Inputs=create_2)  # Creates a group of inputs for UI.MultipleInputForm ++ . Check out www.data-shapes.net for more infos !
create_3 = List.Create(ui_textnote_data, ui_inputgroup_data)

# group (continued): UI
ui_multipleinputform_2 = Custom[UI.MultipleInputForm ++](Description_optional=code_block_30.out0, ButtonText_optional=code_block_30.out1, Inputs=create_3, Toggle=boolean_3, CancelButtonText_optional=code_block_31, Width_optional=code_block_32)

# group: Determine if script should 'stop' or not
firstItem_5 = List.FirstItem(ui_multipleinputform_2.Was_Cancelled)
code_block_36 = CodeBlock { ""; }
if_2 = If(test=firstItem_5, true=code_block_36, false=ui_multipleinputform.User_Inputs)

watch = Watch(if_2)

# group: Revit category of element to PRODUCT class(es)
getCategory = Element.GetCategory(watch)
string_from_object = FromObject(getCategory)
firstItem_6 = List.FirstItem(string_from_object)
filePath = HomeSpacePath()  # "SpringsUI.Graph.FilePath"
make_relative_path_to_excel_file = Python(IN[0]=filePath)
# ---------- make_relative_path_to_excel_file.python (16 lines) ----------
import clr

#The inputs to this node will be stored as a list in the IN variables.
pathGraph = IN[0]

pathSplitted = pathGraph.split("\\")
pathSplitted = pathSplitted[:len(pathSplitted)-2]
pathExcel = ""

for el in pathSplitted:
	pathExcel += el + "\\"

pathExcel += "MappingTable_RevitCategories-to-Product.xlsx"

#Assign your output to the OUT variable.
OUT = pathExcel
# ----------------------------------------
fromPath = FileObject(make_relative_path_to_excel_file)  # "File.FromPath"
code_block_37 = CodeBlock { "Sheet1"; }
boolean_4 = BoolSelector(true)
readFromFile = Excel.ReadFromFile(file=fromPath, sheetName=code_block_37, readAsStrings=boolean_4)
match_revit_category_to_product = Python(IN[0]=readFromFile, IN[1]=firstItem_6)  # "Match Revit category to PRODUCT class"
# ---------- match_revit_category_to_product.python (21 lines) ----------
import clr

#The inputs to this node will be stored as a list in the IN variables.
mappingList = IN[0] #list of lists with strings
elementCat = IN[1] #string

results = []

for mappingEl in mappingList:
	if mappingEl[0] == elementCat:
		if "," in mappingEl[1]:
			foundClasses = mappingEl[1].split(",")
			for foundClass in foundClasses:
				results.append(mappingEl[2] + foundClass)
		else: results.append(mappingEl[2] + mappingEl[1])
		break #each revit category appears only once in the list

# remove duplicates
results = list(set(results))
#Assign your output to the OUT variable.
OUT = results
# ----------------------------------------

# group: Storey_URI of Level of Revit element
level = Custom[Element.Level](element=watch)  # Gets an element's level
code_block_38 = CodeBlock { "storey_URI"; "Name"; }
getParameterValueByName_4 = Element.GetParameterValueByName(element=level, parameterName=code_block_38.out1)
firstItem_7 = List.FirstItem(getParameterValueByName_4)
getParameterValueByName_5 = Element.GetParameterValueByName(element=level, parameterName=code_block_38.out0)
firstItem_8 = List.FirstItem(getParameterValueByName_5)

# group: Find nearest levels below bounding box points of element
categories_3 = Categories("Levels")
all_elements_of_category_3 = ElementsOfCategory(categories_3)
code_block_39 = CodeBlock { "Elevation"; }
getParameterValueByName_6 = Element.GetParameterValueByName(element=all_elements_of_category_3, parameterName=code_block_39)
sortListByAnother = Archilab.Grimshaw.List.List.SortListByAnother(all_elements_of_category_3, getParameterValueByName_6)
boundingBox = Geometry.BoundingBox(watch)
maxPoint = BoundingBox.MaxPoint(boundingBox)
Z = Point.Z(maxPoint)
minPoint = BoundingBox.MinPoint(boundingBox)
Z_2 = Point.Z(minPoint)
find_nearest_level_s_below = Python(IN[0]=sortListByAnother.out0, IN[1]=sortListByAnother.out1, IN[2]=Z, IN[3]=Z_2)  # "Find nearest level(s) below points + in between levels"
# ---------- find_nearest_level_s_below.python (56 lines) ----------
import clr

#The inputs to this node will be stored as a list in the IN variables.
levels = IN[0] # sorted from low to heigh
levelElevations = IN[1] # sorted from low to heigh
boundingBoxMaxZs = IN[2]
boundingBoxMinZs = IN[3]

boundingBoxMaxZ = round(boundingBoxMaxZs[0]) #input is list with one double value for z, rounded to most close mm
boundingBoxMinZ = round(boundingBoxMinZs[0]) #input is list with one double value for z, rounded to most close mm
lowestLevelIndex = None
highestLevelIndex = None

foundLevels = []

# find index of lowest level in list
for i, levelElevation in list(enumerate(levelElevations)):
	if i == 0 and boundingBoxMinZ < levelElevation: # point is below all levels
		break
	if boundingBoxMinZ < levelElevation and lowestLevelIndex is None:
		for k, b in list(enumerate(levelElevations)): # there might be 'lower' levels in the list with the same elevation
			if levelElevations[i-1] == b:
				lowestLevelIndex = k
				break
	if i == len(levels)-1 and boundingBoxMinZ >= levelElevation: #if point above all levels
		for k, b in list(enumerate(levelElevations)): # there might be 'lower' levels in the list with the same elevation
			if levelElevation == b:
				lowestLevelIndex = k
				break

# find index of highest level in list
for i, levelElevation in list(enumerate(levelElevations)):
	if i == 0 and boundingBoxMaxZ < levelElevation: # point is below all levels
		break
	if boundingBoxMaxZ < levelElevation and highestLevelIndex is None:
		highestLevelIndex = i - 1
		break
	if i == len(levels)-1 and boundingBoxMaxZ >= levelElevation: #if point above all levels
		highestLevelIndex = i

# return all levels between both indexes
diff = highestLevelIndex - lowestLevelIndex
if diff == 0:
	foundLevels.append(levels[lowestLevelIndex])
if diff == 1:
	foundLevels.append(levels[lowestLevelIndex])
	foundLevels.append(levels[highestLevelIndex])
if diff > 1:
	foundLevels.append(levels[lowestLevelIndex])
	for i in range(diff - 1):
		foundLevels.append(levels[lowestLevelIndex + i + 1])
	foundLevels.append(levels[highestLevelIndex])
		
#################################################################
#Assign your output to the OUT variable.
OUT = foundLevels
# ----------------------------------------
setDifference = SetDifference(find_nearest_level_s_below, level)
code_block_40 = CodeBlock { "storey_URI"; "Name"; }
getParameterValueByName_7 = Element.GetParameterValueByName(element=setDifference, parameterName=code_block_40.out1)
getParameterValueByName_8 = Element.GetParameterValueByName(element=setDifference, parameterName=code_block_40.out0)

# group: Spaces that intersect with the Revit element (= containsElement or adjacentElement)
categories_4 = Categories("MEPSpaces")
all_elements_of_category_4 = ElementsOfCategory(categories_4)
isUnbounded = Custom[Room.IsUnbounded](room=all_elements_of_category_4)  # Checks whether a room is unbounded.
filterByBoolMask_2 = List.FilterByBoolMask(list=all_elements_of_category_4, mask=isUnbounded)
geometry = Element.Geometry(filterByBoolMask_2.out)
flatten_3 = Flatten(geometry)
geometry_2 = Element.Geometry(watch)
flatten_4 = Flatten(geometry_2)
doesIntersect = Geometry.DoesIntersect(geometry=flatten_3, other=flatten_4, lacing=CrossProduct)
code_block_41 = CodeBlock { "space_URI"; {"Name","Number"}; }

code_block_42 = CodeBlock { true; }
contains_3 = Contains(arg1=code_block_42)  # unwired: arg0
map_7 = List.Map(list=doesIntersect, f_x=contains_3)

# group (continued): Spaces that intersect with the Revit element (= containsElement or adjacentElement)
filterByBoolMask_3 = List.FilterByBoolMask(list=filterByBoolMask_2.out, mask=map_7)
getParameterValueByName_9 = Element.GetParameterValueByName(element=filterByBoolMask_3.in, parameterName=code_block_41.out1, lacing=CrossProduct)
getParameterValueByName_10 = Element.GetParameterValueByName(element=filterByBoolMask_3.in, parameterName=code_block_41.out0)

# group: Info about selected Revit element
code_block_43 = CodeBlock { "The selected Revit element"; }
# note: IN[0] = Revit category
# IN[1] = Revit Level (name)
# IN[2] = Revit nearby Levels (names)
# IN[3] = intersecting Revit Spaces (names + numbers)
string_info_of_selected_revit = Python(IN[0]=firstItem_6, IN[1]=firstItem_7, IN[2]=getParameterValueByName_7, IN[3]=getParameterValueByName_9)  # "String info of selected Revit element"
# ---------- string_info_of_selected_revit.python (22 lines) ----------
import clr

#The inputs to this node will be stored as a list in the IN variables.
revitCat = IN[0] #string
revitLevel = IN[1] #name string
revitNearbyLevels = IN[2] #list of name strings, can be empty list
revitSpaces = IN[3] # list of lists (name and number), can be empty list

returnString = "Revit Category: " + revitCat + "\nRevit Level: " + revitLevel
if revitNearbyLevels is not None and len(revitNearbyLevels) > 0:
	returnString += "\nOther nearby Revit Level(s): "
	for revitNearbyLevel in revitNearbyLevels:
		returnString += revitNearbyLevel + " ; "
	returnString = returnString[:-3]
if revitSpaces is not None and len(revitSpaces) > 0:
	returnString += "\nIntersecting Revit Space(s): "
	for revitSpace in revitSpaces:
		returnString += revitSpace[0] + " (" + revitSpace[1] + ") ; "
	returnString = returnString[:-3]

#Assign your output to the OUT variable.
OUT = returnString
# ----------------------------------------

# group: Query graph: superclasses of product class
URL_2 = StringInput("localhost:5820")
user_password_2 = StringInput("admin")
query_2 = StringInput("""SELECT ?productClasses (GROUP_CONCAT(DISTINCT ?superclass) AS ?superclasses) WHERE {
?productClasses rdfs:subClassOf ?superclass .
FILTER ( ?superclass != owl:Thing )
#FILTER ( ?superclass != <https://w3id.org/product#Product> )
FILTER ( ?superclass != ?productClasses )
VALUES ?productClasses {<listOfClasses>
}
}
GROUP BY ?productClasses""")
code_block_44 = CodeBlock { "<listOfClasses>"; }
prepare_classes_for_values = Python(IN[0]=match_revit_category_to_product)
# ---------- prepare_classes_for_values.python (10 lines) ----------
import clr

#The inputs to this node will be stored as a list in the IN variables.
listOfClasses = IN[0]

str = ""
for c in listOfClasses:
	str = str + "\n <" + c + ">"
#Assign your output to the OUT variable.
OUT = str
# ----------------------------------------
replace_3 = String.Replace(str=query_2, searchFor=code_block_44, replaceWith=prepare_classes_for_values)
code_block_45 = CodeBlock { "building"; }
replace_4 = String.Replace(str=replace_3, searchFor=code_block_45, replaceWith=getParameterValueByName_2)
reasoning_2 = BoolSelector(true)
go_2 = BoolSelector(true)
# note: url = IN[0]
# db = IN[1]
# user = IN[2]
# password = IN[3]
# query = IN[4]
# reasoning = IN[5]
# go = IN[6]
sparql_get_2 = Python(IN[0]=URL_2, IN[1]=getParameterValueByName, IN[2]=user_password_2, IN[3]=user_password_2, IN[4]=replace_4, IN[5]=reasoning_2, IN[6]=go_2)  # same code as sparql_get

# group: JSON handling
string_4 = JsonData.Utilities.Parse.String(sparql_get_2)
string_5 = StringInput("results.bindings")
getValueByKey_3 = JsonData.Elements.JsonObject.GetValueByKey(string_4, string_5)
code_block_46 = CodeBlock { {"superclasses.value"}; }
getValueByKey_4 = JsonData.Elements.JsonObject.GetValueByKey(getValueByKey_3, code_block_46, lacing=Longest)

# group: Handling list
code_block_47 = CodeBlock { " "; }
split_5 = String.Split(arg1=code_block_47)  # unwired: arg0
map_8 = List.Map(list=getValueByKey_4, f_x=split_5)
sort_list_place_buildingelement = Python(IN[0]=map_8)  # "sort list + place buildingElement and product:Product at the end"
# ---------- sort_list_place_buildingelement.python (22 lines) ----------
import clr

#The inputs to this node will be stored as a list in the IN variables.
listOfLists = IN[0]

for el in listOfLists:
	el.sort(reverse=True) #sort sublist
	for e in el:
		if e == "https://w3id.org/product/BuildingElements#BuildingElement":
			el.remove("https://w3id.org/product/BuildingElements#BuildingElement")
			el.append("https://w3id.org/product/BuildingElements#BuildingElement")
	for e in el:
		if e == "https://w3id.org/product/Furnishing#Furniture":
			el.remove("https://w3id.org/product/Furnishing#Furniture")
			el.append("https://w3id.org/product/Furnishing#Furniture")
	for e in el:
		if e == "https://w3id.org/product#Product":
			el.remove("https://w3id.org/product#Product")
			el.append("https://w3id.org/product#Product")

#Assign your output to the OUT variable.
OUT = listOfLists
# ----------------------------------------

make_sublist = Python(IN[0]=ui_multipleinputform_2.User_Inputs)
# ---------- make_sublist.python (7 lines) ----------
import clr
#The inputs to this node will be stored as a list in the IN variables.
weights = IN[0]
weights = [weights[0],[weights[1],weights[2],weights[3],weights[4]],weights[5],weights[6],weights[7]]

#Assign your output to the OUT variable.
OUT = weights
# ----------------------------------------

# group: Compare graph elements with Revit elements
# note: IN[0] = product class(es)
# IN[1] = product superClass(es)
# IN[2] = storey of element
# IN[3] = other nearby storeys of element
# IN[4] = spaces intersecting with the element
# IN[5] = all elements in graph
# IN[6] = weights per test
compare_revit_element_with = Python(IN[0]=match_revit_category_to_product, IN[1]=sort_list_place_buildingelement, IN[2]=firstItem_8, IN[3]=getParameterValueByName_8, IN[4]=getParameterValueByName_10, IN[5]=transpose_2, IN[6]=make_sublist)  # "Compare Revit element with elements from graph"
# ---------- compare_revit_element_with.python (126 lines) ----------
import clr

# inputs of selected revit element
productClasses = IN[0] #list of product classes that corresponds with the Revit category of the Revit element (never empty list assumed in normal situations)
listSuperProductClasses = IN[1] # list of lists of super classes of product classes that correspond with the Revit category (never empty assumed in normal situations) => sorted from most specific to generic
storeyElement = IN[2] #one storey_URI string of Level of Revit element (never null)
nearbyStoreysElement = IN[3] #list of storey_URI strings of nearby Revit Levels without actual Level of element (can be empty list)
spacesElement = IN[4] #list of space_URI strings of Revit spaces that intersect with the element geometry (can be empty list)

# bot:Elements found in Stardog db
allElements = IN[5] # list of sublists per element (12)

# weights per test (5)
weights = IN[6] # list of floats per test, two for second test but nested (total:4+2)

##############################################
#declare variables for the scores
scoresTest1 = []
scoresTest2 = []
scoresTest3 = []
scoresTest4 = []
scoresTest5 = []
#variable list for info per element
infoStrings = []

#test 1: bot:Element has props:revit_uuid_simple
for el in allElements:
	if el[1] is not None:
		scoresTest1.append(0)
	else: scoresTest1.append(1*weights[0])

#test2: match product classes
for el in allElements:
	if el[2] is not None:
		scoreTest2Direct = 0
		scoreTest2Super = 0
		for productClass in productClasses: #product class(es) based on Revit category mapping
			for product in el[2]: #product classes of graph element
				if product == productClass:
					scoreTest2Direct = 1*weights[1][0] #direct match
					break
		if scoreTest2Direct == 0: #test only if no direct match was found
			for superProductClasses in listSuperProductClasses: #super product classes of product class based on Revit category mapping
				i = 0
				for superProductClass in superProductClasses:
					i += 1
					for product in el[2]:
						scoreTemp = 1*weights[1][i]
						if superProductClass == product and scoreTemp > scoreTest2Super:
							scoreTest2Super = scoreTemp
							break
		scoresTest2.append(max(scoreTest2Direct,scoreTest2Super))
	else: scoresTest2.append(0)
			
#test3: matching revit level to bot:Storey
for el in allElements:
	if storeyElement == el[3]: #el[3] is storey uri (always exactly one assumed)
		scoresTest3.append(1*weights[2])
	else:
		scoresTest3.append(0)

#test4: matching nearby revit levels to bot:Storey
for el in allElements:
	found = False
	for nearbyStorey in nearbyStoreysElement:
		if nearbyStorey == el[3]: #el[3] is storey uri (always exactly one assumed)
			found = True
			break
	if found:
		scoresTest4.append(1*weights[3])
	else:
		scoresTest4.append(0)

#test5: matching related spaces
if spacesElement is not None: #can be empty list
	k = -1
	for el in allElements:
		k += 1
		if el[6] is not None: # assumed there is no space adjacent to the element (assumed that only 1 space contains the element) => can be null
			#scoresTest5.append(0)
			#for spaceElement in spacesElement:
			#	if el[6] == spaceElement:
			#		scoresTest5[k] = weights[4]*1
			#		break
			totalGraph = 1.0 #number of cont spaces in graph to element (for now assumed max 1)
			totalRevit = float(len(spacesElement)) #number of Revit spaces intersecting or touching the selected Revit element
			count = 0.0
			for spaceElement in spacesElement:
				if el[6] == spaceElement: #assumed only contained in one space
					count += 1.0
					break
			scoresTest5.append(((2.0*count)/(totalGraph + totalRevit))*weights[4])
		elif el[9] is not None: # assumed there is no space that contains the element (1 or more spaces are adjacent to the element) => can be empty list
			totalGraph = float(len(el[9])) #number of adj spaces in graph to element
			totalRevit = float(len(spacesElement)) #number of Revit spaces intersecting or touching the selected Revit element
			count = 0.0
			for spaceAdj in el[9]:
				for spaceElement in spacesElement:
					if spaceAdj == spaceElement:
						count += 1.0
						break
			#scoresTest5.append(str(total) + " and count: " + str(count))
			scoresTest5.append(((2.0*count)/(totalGraph + totalRevit))*weights[4])
		else:
			scoresTest5.append(0)
else:
	scoresTest5 = [0] * len(allElements)
		

# make sum of totals
scoresTotal = []
for i in range(len(allElements)):
	scoreTotal = scoresTest1[i] + scoresTest2[i] + scoresTest3[i] + scoresTest4[i] + scoresTest5[i]
	scoresTotal.append(scoreTotal)

#change full URIs to prefix and end




# transpose: scores per element
#scoresAll = [scoresTotal,scoresTest1,scoresTest2,scoresTest3,scoresTest4,scoresTest5] 
#scoresAll = map(list, zip(*[scoresTest1,scoresTest2,scoresTest3,scoresTest4,scoresTest5])) #transpose list

#Assign your output to the OUT variable.
OUT = [scoresTotal,scoresTest1,scoresTest2,scoresTest3,scoresTest4,scoresTest5] 
# ----------------------------------------
graph_elements_info_to_string = Python(IN[0]=transpose_2, IN[1]=compare_revit_element_with)
# ---------- graph_elements_info_to_string.python (132 lines) ----------
import clr

#The inputs to this node will be stored as a list in the IN variables.
allElements = IN[0]
scores = IN[1]

# break input list in parts
scoresTotal = scores[0]
scoresTest1 = scores[1]
scoresTest2 = scores[2]
scoresTest3 = scores[3]
scoresTest4 = scores[4]
scoresTest5 = scores[5]

infoStrings = []

#change full URIs to prefix and end
prefixList = [] #initial part of URI before last '#'
elUriPrefixList = [] #list of elements URI with prefix (inst0,inst1,etc. => according prefixList index) 

for el in allElements:
	if "#" not in el[0]: 
		splittedUri = el[0].split('/')
		s = ""
		for i in range(len(splittedUri)):
			if i < len(splittedUri)-1:
				s += splittedUri[i] + "/"
		if prefixList is None:
			prefixList.append(s)
			elUriPrefixList.append("inst0:" + splittedUri[-1])
		else:
			i = -1
			found = False
			for prefix in prefixList:
				i += 1
				if s == prefix:
					elUriPrefixList.append("inst" + str(i) + ":" + splittedUri[-1])
					found = True
					break
			if not found: #prefix doesn't exist yet
				prefixList.append(s)
				elUriPrefixList.append("inst" + str(len(prefixList)-1) + ":" + splittedUri[-1])
	else:
		splittedUri = el[0].split('#')
		s = ""
		for i in range(len(splittedUri)):
			if i < len(splittedUri)-1:
				s += splittedUri[i] + "#"
		if prefixList is None:
			prefixList.append(s)
			elUriPrefixList.append("inst0:" + splittedUri[-1])
		else:
			i = -1
			found = False
			for prefix in prefixList:
				i += 1
				if s == prefix:
					elUriPrefixList.append("inst" + str(i) + ":" + splittedUri[-1])
					found = True
					break
			if not found: #prefix doesn't exist yet
				prefixList.append(s)
				elUriPrefixList.append("inst" + str(len(prefixList)-1) + ":" + splittedUri[-1])

# make one string per element containing the info
k = -1
for el in allElements:
	k += 1
	# element URI
	elUriStr = elUriPrefixList[k]
	#product classes => only most specific one
	prodStr = "PRODUCT = "
	prodUriStr = ""
	if el[2] is not None:
		#MEP has not one superclass
		buil = "https://w3id.org/product/BuildingElements#BuildingElement"
		furn = "https://w3id.org/product/Furnishing#Furniture"
		prod = "https://w3id.org/product#Product"
		if len(el[2]) == 1:
			el[2] = el[2][0]
		elif len(el[2]) == 2:
			el[2].remove(prod)
			el[2] = el[2][0]
		elif len(el[2]) > 2:
			el[2].remove(prod)
			for e in el[2]:
				if e == buil:
					el[2].remove(buil)
				if e == furn:
					el[2].remove(furn)
			el[2].sort(reverse=True)
			el[2] = el[2][0]
		#shorten uri with prefix
		splittedUri = el[2].split('#')
		if splittedUri[0] == "https://w3id.org/product/BuildingElements":
			prodStr += "p4bldg:" + splittedUri[-1]
		elif splittedUri[0] == "https://w3id.org/product/Furnishing":
			prodStr += "furn:" + splittedUri[-1]
		elif splittedUri[0] == "https://w3id.org/product/MEP":
			prodStr += "mep:" + splittedUri[-1]
		elif splittedUri[0] == "https://w3id.org/product":
			prodStr += "prod:" + splittedUri[-1]
		#prodUriStr
		prodUriStr = prodStr
	#storey name
	if el[4] is not None:
		storeyStr = "STOREY = " + el[4]
	else: storeyStr = "STOREY = undefined"
	#space contained el - names and number
	spaceContStr = ""
	if el[6] is not None: #assumed there can only be max 1 containing space
		if el[7] is not None:
			spaceContStr = "CONTAINED IN SPACE = " + el[7]
		else:
			spaceContStr = "CONTAINED IN SPACE = undefined"
		if el[8] is not None:
			spaceContStr += " (" + el[8] + ")"
		else:
			spaceContStr += " (undefined)"
	#space adj el - names and number
	adjStr = "ADJACENT TO SPACE(S) = "
	spaceAdjStr = ""
	if el[9] is not None:
		for descr in el[10]:
			adjStr += descr + " ; "
		spaceAdjStr = adjStr[:-3] #remove last three characters if it is a ' ; '
	#bring everything together in one string
	#
	infoStrings.append("SCORE = " + str(round(scoresTotal[k],2)) + " (=" + str(scoresTest1[k]) + "+" + str(scoresTest2[k]) + "+" + str(scoresTest3[k]) + "+" + str(scoresTest4[k]) + "+" + str(round(scoresTest5[k],2)) + ")   ELEMENT = " + elUriStr + "   " + prodUriStr + "   " + storeyStr + "   " + spaceContStr + "   " + spaceAdjStr)

#Assign your output to the OUT variable.
OUT = [prefixList,infoStrings]
# ----------------------------------------
code_block_48 = CodeBlock { "Sorted elements from graph"; }
lastItem = List.LastItem(graph_elements_info_to_string)
firstItem_9 = List.FirstItem(compare_revit_element_with)
boolean_5 = BoolSelector(true)
sortListByAnother_2 = Archilab.Grimshaw.List.List.SortListByAnother(lastItem, firstItem_9, boolean_5)
firstItem_10 = List.FirstItem(replaceItemAtIndex_3)
sortListByAnother_3 = Archilab.Grimshaw.List.List.SortListByAnother(firstItem_10, firstItem_9, boolean_5)
boolean_6 = BoolSelector(false)

# group: UI
code_block_49 = CodeBlock { "Select the graph element that corresponds with the selected Revit element"; "Continue"; }
ui_textnote_data_2 = Custom[UI.TextNote Data](Title=code_block_43, TextNote=string_info_of_selected_revit)
ui_dropdown_data = Custom[UI.DropDown Data](InputName=code_block_48, Keys=sortListByAnother_2, Values=sortListByAnother_3, Sorted_optional=boolean_6)  # Create data for DropDown input in UI.MultiInputForm ++ . Check out www.data-shapes.net for more infos.
boolean_7 = BoolSelector(true)
code_block_50 = CodeBlock { "cancel"; }
code_block_51 = CodeBlock { 2000; }

# group: Used prefixes
code_block_52 = CodeBlock { "Prefixes used in results below"; }
firstItem_11 = List.FirstItem(graph_elements_info_to_string)
prefixes_to_string = Python(IN[0]=firstItem_11)
# ---------- prefixes_to_string.python (21 lines) ----------
import clr

#The inputs to this node will be stored as a list in the IN variables.
instPrefixes = IN[0] # list of the used bases, splitted at the last '#' (or '/' if there is no '#')

prefixStr = ""

#data instances namespaces
i = 0
for instPrefix in instPrefixes:
	prefixStr += "inst" + str(i) + ": <" + instPrefix + "> \n"
	i += 1

#product namespaces
prefixStr += "prod: <https://w3id.org/product> \n"
prefixStr += "p4bldg: <https://w3id.org/product/BuildingElements> \n"
prefixStr += "furn: <https://w3id.org/product/Furnishing> \n"
prefixStr += "mep: <https://w3id.org/product/MEP> \n"

#Assign your output to the OUT variable.
OUT = prefixStr
# ----------------------------------------
ui_textnote_data_3 = Custom[UI.TextNote Data](Title=code_block_52, TextNote=prefixes_to_string)

create_4 = List.Create(ui_textnote_data_2, ui_textnote_data_3, ui_dropdown_data)

# group (continued): UI
ui_multipleinputform_3 = Custom[UI.MultipleInputForm ++](Description_optional=code_block_49.out0, ButtonText_optional=code_block_49.out1, Inputs=create_4, Toggle=boolean_7, CancelButtonText_optional=code_block_50, Width_optional=code_block_51)

firstItem_12 = List.FirstItem(ui_multipleinputform_3.User_Inputs)

# group: Set revit_UUID
uniqueId = Element.UniqueId(watch)
code_block_53 = CodeBlock { "revit_UUID"; }
setParameterByName = Element.SetParameterByName(element=watch, parameterName=code_block_53, value=uniqueId)

# group: Query graph: write revit_uuid
URL_3 = StringInput("localhost:5820")
user_password_3 = StringInput("admin")
query_3 = StringInput("""PREFIX props: <https://w3id.org/props#>
DELETE {
?element props:revit_uuid_simple ?origUuid .
}
INSERT {
?element props:revit_uuid_simple <uuid> .
} 
WHERE {
BIND(<<element>> AS ?element)
?element ?p ?o .
OPTIONAL {?element props:revit_uuid_simple ?origUuid .}
}""")
code_block_54 = CodeBlock { "<element>"; }
# note: Assumed for simplicity that every graph bot:Elemente can only have one Revit element assigned at a time.
# Each Revit element can be connected with multiple bot:Element instances
replace_5 = String.Replace(str=query_3, searchFor=code_block_54, replaceWith=firstItem_12)
code_block_55 = CodeBlock { "<uuid>"; }
firstItem_13 = List.FirstItem(uniqueId)
string_between_quotes = Python(IN[0]=firstItem_13)
# ---------- string_between_quotes.python (9 lines) ----------
import clr
clr.AddReference('ProtoGeometry')
from Autodesk.DesignScript.Geometry import *
#The inputs to this node will be stored as a list in the IN variables.
str = IN[0]
str = "\"" + str +"\""

#Assign your output to the OUT variable.
OUT = str
# ----------------------------------------
replace_6 = String.Replace(str=replace_5, searchFor=code_block_55, replaceWith=string_between_quotes)
reasoning_3 = BoolSelector(true)
go_3 = BoolSelector(true)
# note: [0]URL
# [1]DB
# [2]user
# [3]pw
# [4]query
# [5]reasoning?
# [6]go?
post_data = Python(IN[0]=URL_3, IN[1]=getParameterValueByName, IN[2]=user_password_3, IN[3]=user_password_3, IN[4]=replace_6, IN[5]=reasoning_3, IN[6]=go_3)
# ---------- post_data.python (51 lines) ----------
import clr
import sys
sys.path.append('C:\Program Files (x86)\IronPython 2.7\Lib')
import httplib, urllib, json, base64, time

clr.AddReference('ProtoGeometry')
from Autodesk.DesignScript.Geometry import *
#The inputs to this node will be stored as a list in the IN variables.
url = IN[0]
db = IN[1]
user = IN[2]
password = IN[3]
query = IN[4]
reasoning = IN[5]
go = IN[6]

if go:
	
    #DB CONNECTION
	
    # Establish connection
	conn = httplib.HTTPConnection(url)
	
    # Encode username and password in base64
	encodedAuth = base64.b64encode('%s:%s' % (user, password))
	
    # Define headers for authorizatio etc.
	headers = {"authorization": ("Basic %s" % encodedAuth), "Content-type": "application/x-www-form-urlencoded", "Accept": "text/boolean"}
	
    # Define parameters (qyery, reasoning etc.)
	body = 'query=%s' % query
   	#body = urlencode({"query": query, "reasoning": reasoning})
   	#params = urllib.urlencode({"query": query, "reasoning": reasoning})
	
    # Send request
	conn.request('POST', '/'+ db +'/update', body, headers)
	
    # Get response
	response = conn.getresponse()
	
    # Read response
	data = response.status, response.reason
	
    # Close db connection
	conn.close()

else:
	data = "off mode"

#Assign your output to the OUT variable.
OUT = data
# ----------------------------------------
watch_2 = Watch(post_data)

# group: Set element_URI
code_block_56 = CodeBlock { "element_URI"; }
setParameterByName_2 = Element.SetParameterByName(element=watch, parameterName=code_block_56, value=firstItem_12)
